# Grasshopper definition AIStructureGenerator_Case1_optimized_Compare.gh (Grasshopper 1.0.7)

crv = Curve([<curve referenced from the Rhino model> x1201])
crv_2 = Curve([<curve referenced from the Rhino model> x1201])
curvepoint = PointOnCurve(crv, parameter=0.5)
curvepoint_2 = PointOnCurve(crv_2, parameter=0.5)
python = GhPythonScript(pleaserun=Toggle(False))  # -> out, edges, edgelengths, faceareas, bks
# ---------- python: Python ----------
__author__ = "Hao"
__version__ = "2021.8.15"

import rhinoscriptsyntax as rs
import scriptcontext as sc
import Rhino
import ghpythonlib.treehelpers as ghtree
import math
import ghpythonlib.components as gh
import random

import clr
import os
import time
clr.AddReferenceToFileAndPath("C:\\PolyFramework\\PolyFramework.dll")

import Rhino.Geometry as rg
import PolyFramework as pf

if pleaserun :
    
    sc.doc = Rhino.RhinoDoc.ActiveDoc
    rhdoc = Rhino.RhinoDoc.ActiveDoc
    
    rs.Command("_SelLayerNumber "+str(rhdoc.Layers.FindName("_Form_InternalLines").Index))
    primal = pf.PFoam()
    dual = pf.PFoam()
    containerType = pf.ContainerType
    multiData = pf.LoadData.LoadPrimalDual(True)
    guids = multiData[0]
    primal = multiData[1]
    dual = multiData[2]
    containerType = multiData[3]
    
    edgelengths = []
    faceareas = []
    bks = []
    edges = []
    
    for edge in primal.Edges:
        if (edge.Dual) and (edge.Id>=0):
            if (edge.GetLength()>0) and (edge.Dual.Area>0):
                edges.append(edge.CreateLine())
                edgelength = edge.GetLength()
                facearea = edge.Dual.Area/100
                edgelengths.append(edgelength)
                faceareas.append(facearea)
                bk = (facearea*facearea*facearea*facearea*math.pi/4*math.pi*math.pi*200)/(edgelength*edgelength)
                bks.append(bk)
# ---------- end python ----------
python_2 = GhPythonScript(pleaserun=Toggle(False))  # -> out, edges, edgelengths, faceareas, bks; same code as python
crv_3 = Curve(python.edges)
crv_4 = Curve(python_2.edges)
curvepoint_3 = PointOnCurve(crv_3, parameter=0.5)
cps = ClosestPoints(Point=curvepoint, Cloud=curvepoint_3, Count=1)  # -> ClosestPoint, flatten(CPIndex), Distance
curvepoint_4 = PointOnCurve(crv_4, parameter=0.5)
cps_2 = ClosestPoints(Point=curvepoint_2, Cloud=curvepoint_4, Count=1)  # -> ClosestPoint, flatten(CPIndex), Distance
item = ListItem(List=crv_3, Index=cps.CPIndex, Wrap=True)
item_2 = ListItem(List=python.edgelengths, Index=cps.CPIndex, Wrap=True)
item_3 = ListItem(List=python.faceareas, Index=cps.CPIndex, Wrap=True)
item_4 = ListItem(List=python.bks, Index=cps.CPIndex, Wrap=True)
item_5 = ListItem(List=crv_4, Index=cps_2.CPIndex, Wrap=True)
item_6 = ListItem(List=python_2.edgelengths, Index=cps_2.CPIndex, Wrap=True)
item_7 = ListItem(List=python_2.faceareas, Index=cps_2.CPIndex, Wrap=True)
item_8 = ListItem(List=python_2.bks, Index=cps_2.CPIndex, Wrap=True)
sort = SortList(Keys=item_4, ValuesA=item, ValuesB=item_2, ValuesC=item_3)  # -> Keys, ValuesA, ValuesB, ValuesC
sort_2 = SortList(Keys=item_8, ValuesA=item_5, ValuesB=item_6, ValuesC=item_7)  # -> Keys, ValuesA, ValuesB, ValuesC
item_9 = ListItem(List=sort.Keys, Index=0, Wrap=True)  # -> Item1, Item
item_10 = ListItem(List=sort.ValuesB, Index=0, Wrap=True)  # -> Item1, Item
item_11 = ListItem(List=sort.ValuesA, Index=0, Wrap=True)  # -> Item1, Item
item_12 = ListItem(List=sort.ValuesC, Index=0, Wrap=True)  # -> Item1, Item
item_13 = ListItem(List=sort_2.Keys, Index=0, Wrap=True)  # -> Item1, Item
item_14 = ListItem(List=sort_2.ValuesB, Index=0, Wrap=True)  # -> Item1, Item
item_15 = ListItem(List=sort_2.ValuesA, Index=0, Wrap=True)  # -> Item1, Item
item_16 = ListItem(List=sort_2.ValuesC, Index=0, Wrap=True)  # -> Item1, Item
gradient = Gradient(
    LowerLimit=0,
    UpperLimit=100,
    Parameter=item_4,
    stops=[0: RGB(234, 38, 0), 0.25: RGB(234, 126, 0), 0.5: RGB(254, 244, 84), 0.75: RGB(173, 203, 249), 1: RGB(75, 107, 169)])
gradient_2 = Gradient(
    LowerLimit=0,
    UpperLimit=100,
    Parameter=item_8,
    stops=[0: RGB(234, 38, 0), 0.25: RGB(234, 126, 0), 0.5: RGB(254, 244, 84), 0.75: RGB(173, 203, 249), 1: RGB(75, 107, 169)])
panel = Panel(item_9.Item)
panel_2 = Panel(item_9.Item1)
panel_3 = Panel(item_10.Item)
panel_4 = Panel(item_12.Item)
panel_5 = Panel(item_13.Item)
crv_5 = Curve(item_11.Item)
panel_6 = Panel(item_13.Item1)
panel_7 = Panel(item_14.Item)
panel_8 = Panel(item_16.Item)
crv_6 = Curve(item_15.Item)
preview = CustomPreview(Geometry=item, Material=gradient)
preview_2 = CustomPreview(Geometry=item_5, Material=gradient_2)
