# Grasshopper definition AIStructureGenerator_User_Option5_fc2_1to7_3walls_Karamba.gh (Grasshopper 1.0.7)
# plug-ins: Pufferfish, Kangaroo Components, Weaverbird, Kangaroo2 Components, karambaGH

crv = Curve([<curve referenced from the Rhino model> x1052])
crv_2 = Curve([<curve referenced from the Rhino model> x2333])
crv_3 = Curve(crv_2)
brep = Brep([<brep referenced from the Rhino model> x2333])
brep_2 = Brep([<brep referenced from the Rhino model> x1059])
pt = Point([Point(607.9225897, -522.9950986, 0), Point(610.1015759, -530.4233045, 0), Point(610.2373584, -536.7599396, 0), Point(609.7781417, -544.6240679, 0), Point(610.0160312, -549.1279479, 0), Point(607.7579656, -552.3826957, 0)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])
pt_2 = Point([Point(608.6971768, -525.6356812, 0), Point(610.1652269, -533.3937378, 0), Point(609.9809047, -541.1517334, 0), Point(610.0045052, -548.909729, 0), Point(607.4685915, -556.6677856, 0), Point(607.3082886, -559.0415725, 0)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])
explode = Explode(Curve=crv_3, Recursive=True)  # -> Segments, Vertices
brep_3 = Brep(brep)
pt_3 = Point(pt)
diameter = Data([6.611949297, 6.226005175, 6.238761537, 6.217192969, 8.124687643, 6.265009853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])  # disabled
joints = Point([Point(57254.02623, 1686.296773, 0), Point(57279.00572, 1683.558462, 0), Point(57214.26889, 1654.612522, 0), Point(57300.83493, 1657.686077, 0), Point(57295.42743, 1697.21736, 0), Point(57237.96842, 1705.43288, 0)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])  # disabled
load = Data([9.535790067, 9.533951902, 10.10557679, 9.5143305, 11.5442364, 11.57670532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])  # disabled
beams = Curve([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])  # disabled
flatten = FlattenTree(Tree=explode.Segments, Path="{0}")
debrep = DeconstructBrep(Brep=brep_3)  # -> Faces, Edges, Vertices
Z = UnitZ(Factor=100)

# ---- group: Reference Geometry
pt_4 = Point(pt_3)

# ----
dupln = RemoveDuplicateLines(Lines=flatten, Tolerance=0.01)
crv_4 = Curve(dupln)

panel = Panel("0,0,0")  # disabled
preview = CustomPreview(Geometry=crv_4, Material=panel)  # disabled

curvepoint = PointOnCurve(crv_4, parameter=0.5)
boundary = BoundarySurfaces(Edges=crv_3)
extr = Extrude(Base=boundary, Direction=Z)
item = ListItem(List=debrep.Edges, Index=4, Wrap=True)
item_2 = ListItem(List=debrep.Edges, Index=2, Wrap=True)
graft = GraftTree(Tree=curvepoint, IncludeEmptyLists=True, IncludeNullItems=True)
Z_2 = UnitZ(Factor=-50)
brec = BoundingRectangle(Geometry=boundary, Plane=PlaneXY(0, 0, 0), Axis=0, Slide=0, Union=True)  # -> Bounding, DimensionX, DimensionY
len = Length(Curve=item_2)
area = Area(Geometry=item_2)  # -> Area, Centroid
area_2 = Area(Geometry=item)  # -> Area, Centroid
move = Move(Geometry=extr, Motion=Z_2)  # -> Geometry, Transform

# ---- group: Reference Geometry
crv_5 = Curve(crv_4)

# ----
panel_2 = Panel(crv_5)
division = Division(A=len, B=6.283185307)  # -> flatten(Result)
ln = Line(StartPoint=area.Centroid, EndPoint=area_2.Centroid)  # -> flatten(Line)
quaddiv = QuadDivide(Mesh=brec.Bounding, Divisions=25)
lng = ListLength(List=crv_5)
curvepoint_2 = PointOnCurve(ln, parameter=0.5)
wbedges = WeaverbirdsMeshEdges(MeshOrPolylines=quaddiv)
series = Series(Start=0, Step=1, Count=lng)
trim = TrimWithBrep(Curve=wbedges, Brep=move.Geometry)  # -> Inside, Outside
cp = ClosestPoint(Point=graft, Cloud=curvepoint_2)  # -> ClosestPoint, CPIndex, Distance
matprops = MaterialPropertiesKaramba3D(
    FamilyOfMaterial="Steel",
    Name="S235",
    YoungsModulus_kN_cm2=350,
    InPlaneShearModulus_kN_cm2=175,
    TransverseShearModulus_kN_cm2=337,
    SpecificWeight_kN_m3=78.5,
    CoefficientOfThermalExpansion_1_C=1e-05,
    YieldStrength_kN_cm2=23.5,
    mode="Isotrop")
txt = Text(series)
graft_2 = GraftTree(Tree=txt, IncludeEmptyLists=True, IncludeNullItems=True)
ins = InsertItems(List=graft_2, Item="A", Indices=0, Wrap=True)
join = TextJoin(Text=ins)  # -> flatten(Result)
panel_3 = Panel("material PLA")
item_3 = ListItem(List=division, Index=cp.CPIndex, Wrap=True)  # -> flatten(Item)
crv_6 = Curve(flatten(trim.Inside))
panel_4 = Panel("-9.8067e-12")
len_2 = Length(Curve=crv_4)
ccx = CurveCurve(CurveA=boundary, CurveB=crv_6)  # -> Points, flatten(ParamsA), ParamsB
pt_5 = Point(Point(51827.29254, 2377.144296, 0))
pt_6 = Point(Point(2620.13948, 2755.021686, 0))
sqr = Square(Value=item_3)
panel_5 = Panel("1")
panel_6 = Panel("1gr load")
sort = SortList(Keys=ccx.ParamsA)  # -> Keys, ValuesA
pt_7 = Point(pt_5)
multiplication = Multiplication(A=sqr, B=3.141592654)
Z_3 = UnitZ(Factor="-9.8067e-5")
volume = Volume(Geometry=brep_3)  # -> Volume, Centroid
panel_7 = Panel("0.01")
multiplication_2 = Multiplication(A=multiplication, B=len_2)
loads = LoadsKaramba3D(ForceVector=Z_3, Local=False, PosInd=pt_7, LCase=0, mode="Point")
eval = EvaluateCurve(Curve=boundary, Parameter=sort.Keys)  # -> Point, Tangent, Angle
ma = MassAddition(Input=volume.Volume)  # -> Result, PartialResults
ma_2 = MassAddition(Input=multiplication_2)  # -> Result, PartialResults
pline = PolyLine(Vertices=eval.Point, Closed=True)
division_2 = Division(A=ma.Result, B=ma_2.Result)
explode_2 = Explode(Curve=pline, Recursive=True)  # -> Segments, Vertices
sqrt = SquareRoot(Value=division_2)
multiplication_3 = Multiplication(A=sqrt)
multiplication_4 = Multiplication(A=item_3, B=multiplication_3)
multiplication_5 = Multiplication(A=multiplication_4, B=2)
cross_section = CrossSectionKaramba3D(
    FamilyNameOfCrossSection="DefaultCroSec",
    ElementIdentifier=join,
    Material=matprops,
    Diameter_cm=multiplication_5,
    WallThickness_cm=multiplication_4,
    mode="Circular Hollow")

# ---- group: Define Elements
linetobeam = LineToBeamKaramba3D(
    Line=crv_5,
    Identifier=join,
    CrossSection=cross_section,
    New=True,
    Remove=True,
    LimitDistance_m=0.005,
    Bending=Toggle(True))  # -> Element, Points, Info

# ---- group: Reference Geometry
pt_8 = Point(linetobeam.Points)

# ---- group: Define Supports
fsim = FindSimilarMember(Data=pt_4, Set=linetobeam.Points)  # -> Hit, Index
cull_i = CullIndex(List=linetobeam.Points, Indices=fsim.Index, Wrap=True)
supp = SupportKaramba(PosInd=pt_4, menu=[buttons(on, on, on, on, on, on)])
supp_2 = SupportKaramba(PosInd=cull_i, menu=[buttons(off, on, off, on, off, on)])
support = SupportKaramba(flatten(supp))

# ----
pipe = Pipe(Curve=crv_4, Radius=multiplication_4, Caps=0)
pt_9 = Point(linetobeam.Points)
sqr_2 = Square(Value=multiplication_4)
graft_3 = GraftTree(Tree=pt_9, IncludeEmptyLists=True, IncludeNullItems=True)
crv_cp = CurveClosestPoint(Point=graft_3, Curve=crv_4)  # -> Point, Parameter, Distance
multiplication_6 = Multiplication(A=sqr_2, B=3.141592654)
panel_8 = Panel(linetobeam.Points)
smaller = SmallerThan(FirstNumber=crv_cp.Distance, SecondNumber=0.01)  # -> SmallerThan, OrEqualTo
multiplication_7 = Multiplication(A=len_2, B=multiplication_6)
multiplication_8 = Multiplication(A=multiplication_7, B=1.26)
cull = CullPattern(List=multiplication_8, CullPattern=smaller.SmallerThan)  # -> simplify(List)
ma_3 = MassAddition(Input=cull)  # -> flatten(Result), PartialResults
merge = Merge(Data1=flatten(crv_6), Data2=flatten(explode_2.Segments))
crv_7 = Curve(merge)
division_3 = Division(A=ma_3.Result, B=1000)
len_3 = Length(Curve=merge)
ma_4 = MassAddition(Input=len_3)  # -> Result, PartialResults
multiplication_9 = Multiplication(A=division_3, B=9.8)
division_4 = Division(A=ma.Result, B=ma_4.Result)
division_5 = Division(A=multiplication_9, B=1000)
division_6 = Division(A=division_4, B=3.141592654)
division_7 = Division(A=division_5, B=10)
neg = Negative(Value=division_7)
multiplication_10 = Multiplication(A=neg, B=Slider(0.0003, range=0..1))
data = Data(multiplication_10)
sqrt_2 = SquareRoot(Value=division_6)
pipe_2 = Pipe(Curve=merge, Radius=sqrt_2, Caps=2)  # -> flatten(Pipe)
brep_4 = Brep(pipe_2)
project = Project(Geometry=crv_4, Plane=PlaneXY(0, 0, 0))  # -> Geometry, Transform
curvepoint_3 = PointOnCurve(project.Geometry, parameter=0.5)

# ---- group: Define Loads
panel_9 = Panel("-1")
Z_4 = UnitZ(Factor="-9.8067e-9")
Z_5 = UnitZ(Factor=data)

# ----
loads_2 = LoadsKaramba3D(ForceVector=Z_5, Local=False, PosInd=pt_8, LCase=0, mode="Point")
loads_3 = LoadsKaramba3D(Vector=Z_4, LCase=0, mode="Gravity")

# ---- group: Define Loads (continued)
load_2 = LoadKaramba3D(flatten(loads_2))

# ---- group: Assemble Model
assemble = AssembleModelKaramba(Elem=linetobeam.Element, Support=support, Load=load_2, LimitDistance_m=0.005)  # -> Model, Info, Mass_kg, CenterOfGravity

# ---- group: Analyze Model
analyze = AnalyzeKaramba3D(Model=assemble.Model)  # -> CalculatedModel, MaximumDisplacement_cm, ResultingForceOfGravity_kN, ElasticEnergy_kNm
displacement = Panel(analyze.MaximumDisplacement_cm)

# ---- group: View Results
modelview = ModelViewKaramba3D(Model=analyze.CalculatedModel, LoadCaseFactorsForLinearSuperposition=1, IndexOfVisibleLoadcase=-1)  # -> Model, DeformedMesh, DeformedAxes, DeformedModel
beamview = BeamViewKaramba3D(Model=modelview.Model)  # -> Model, MeshesOfRenderedBeams, DeformedBeamAxes, LegendColors, LegendTags
legend = Legend(Colour=beamview.LegendColors, Tags=beamview.LegendTags, LegendType=1)

# ---- group: Check Beam Displacements
# -You can call a specific group of beams using
# the 'BeamIds' input.
# -Adding '3' to the resolution input provides values
# at the middle of each beam in addition to the
# two ends (default).
panel_10 = Panel("3")
beamdisp = BeamDisplacementsKaramba(
    AnalyzedModel=analyze.CalculatedModel,
    LoadCase=-1,
    MaximumDistanceBetweenResults_ft=-1,
    NumberOfResultsPerElement=panel_10)  # -> AnalyzedModel, simplify(Translations_ft), Rotations_rad
panel_11 = Panel(beamdisp.Translations_ft)

# ---- group: Check Beam Internal Forces
# -You can call a specific group of beams using
# the 'BeamIds' input.
# -Adding '3' to the resolution input provides values
# at the middle of each beam in addition to the
# two ends (default).
panel_12 = Panel("3")
b_forces = BeamForcesKaramba(
    AnalyzedModel=analyze.CalculatedModel,
    LCase=-1,
    MaximumDistanceBetweenResults_m=-1,
    NumberOfResultsPerBeamElement=panel_12)  # -> AnalyzedModel, NormalForce_kN, ShearForceVz_kN, ShearForceVy_kN, BendingMomentMt_kNm, BendingMomentMy_kNm, BendingMomentMz_kNm
panel_13 = Panel(b_forces.NormalForce_kN)

# ----
crv_8 = Curve(modelview.DeformedAxes)
project_2 = Project(Geometry=crv_8, Plane=PlaneXY(0, 0, 0))  # -> Geometry, Transform
curvepoint_4 = PointOnCurve(project_2.Geometry, parameter=0.5)
cp_2 = ClosestPoint(Point=curvepoint_4, Cloud=curvepoint_3)  # -> ClosestPoint, CPIndex, Distance
item_4 = ListItem(List=crv_4, Index=cp_2.CPIndex, Wrap=True)
end = EndPoints(Curve=crv_8)  # -> Start, End
end_2 = EndPoints(Curve=item_4)  # -> Start, End
dist = Distance(PointA=end.Start, PointB=end_2.Start)
dist_2 = Distance(PointA=end.End, PointB=end_2.End)
rulesrf = RuledSurface(CurveA=crv_8, CurveB=item_4)
addition = Addition(A=dist, B=dist_2)
division_8 = Division(A=addition, B=2)
sort_2 = SortList(Keys=division_8)  # -> Keys, ValuesA
item_5 = ListItem(List=sort_2.Keys, Index=0, Wrap=True)  # -> Item1, Item
ma_5 = MassAddition(Input=division_8)  # -> Result, PartialResults
gradient = Gradient(LowerLimit=0, UpperLimit=20, Parameter=division_8, stops=[0: RGB(0, 0, 255), 0.5: RGB(128, 0, 128), 1: RGB(255, 0, 0)])
panel_14 = Panel(ma_5.Result)
panel_15 = Panel(item_5.Item1)
panel_16 = Panel(item_5.Item)
preview_2 = CustomPreview(Geometry=crv_8, Material=gradient)
