# Grasshopper definition AIStructureGenerator_User_EFC_APW_Web.gh (Grasshopper 1.0.7)
# plug-ins: Karamba3D, Kangaroo Components, LunchBox, Kangaroo2 Components

file = ReadFile(File="C:\AIStructureGenerator\webtool\ghBackend\media\Default\input.txt", PerLineParse=True)
item = ListItem(List=file, Index=0, Wrap=True)
split = TextSplit(Text=item, Separators="[")
split_2 = TextSplit(Text=file, Separators=",")  # -> simplify(Result)
split_3 = TextSplit(Text=split, Separators="]")
branch = TreeBranch(Tree=split_2, Path="{1}", MaintainPaths=True)
branch_2 = TreeBranch(Tree=split_2, Path="{2}", MaintainPaths=True)
branch_3 = TreeBranch(Tree=split_2, Path="{3}", MaintainPaths=True)
branch_4 = TreeBranch(Tree=split_2, Path="{4}", MaintainPaths=True)
branch_5 = TreeBranch(Tree=split_2, Path="{5}", MaintainPaths=True)
branch_6 = TreeBranch(Tree=split_2, Path="{6}", MaintainPaths=True)
branch_7 = TreeBranch(Tree=split_2, Path="{7}", MaintainPaths=True)
split_4 = TextSplit(Text=split_3, Separators=",")  # -> simplify(flatten(Result))
panel = Panel(branch)
panel_2 = Panel(branch_2)
panel_3 = Panel(branch_3)
panel_4 = Panel(branch_4)
panel_5 = Panel(branch_5)
num = Number(split_4)
null = NullItem(Item=num)  # -> NullFlags, InvalidFlags, Description
subtraction = Subtraction(A=1, B=panel)
not = GateNot(A=null.NullFlags)
panel_6 = Panel(subtraction)
cull = CullPattern(List=num, CullPattern=not)
join = TextJoin(Text=cull, Join=",")
merge = Merge(
    Data1=flatten(join),
    Data2=flatten(branch),
    Data3=flatten(branch_2),
    Data4=flatten(branch_3),
    Data5=flatten(branch_4),
    Data6=flatten(branch_5),
    Data7=flatten(branch_6),
    Data8=flatten(branch_7))
division = Division(A=cull, B=500)
dispatch = Dispatch(List=division, DispatchPattern=[True, False])  # -> ListA, ListB
pt = ConstructPoint(XCoordinate=dispatch.ListA, YCoordinate=dispatch.ListB, ZCoordinate=0)
pline = PolyLine(Vertices=pt, Closed=True)
scale = Scale(Geometry=pline, Center=Point(0, 0, 0), Factor=3000)  # -> Geometry, Transform

# ----
# 01 INPUT
# The form boundary should be a closed curvature with an approximate width of 3000-5000 unit in Rhino.
list = ValueList({"DragonflyWings", "DamselflyWings", "GrasshopperWings", "AmazonWaterLily", "AutoMode"}, selected="DragonflyWings")
form_boundary = Curve(scale.Geometry)
select_mode = Select_mode(G=form_boundary, mode=list)

txt = Text(merge)

# ----
# 02 GENERATING FORCE IMAGE (fc2_1to7)
# 03 - switch to True - to recognize the image and generate the force geometry
panel_7 = Panel("01 - switch to True")
generate_input_image = Generate_Input_Image(txt=select_mode, crv=form_boundary, run=Toggle(True))  # -> file_path, pt_10, pt_8, pt_9
panel_8 = Panel("02 - switch to True")
generate_force_image_fc2_1to7 = GhPythonScript(type=select_mode, file_path=generate_input_image.file_path, run=Toggle(True))  # -> out, file_path; inputs run: Boolean
# ---------- generate_force_image_fc2_1to7: Python ----------
__author__ = "Platina"
__version__ = "2021.07.19"

#encoding=utf-8
import os
import shutil
import rhinoscriptsyntax as rs
from subprocess import Popen, PIPE
DETACHED_PROCESS = 0x00000008

import ghpythonlib.components as gh

if run:
    
    if type=="DragonflyWings":
        os.system("cd C:\\AIStructureGenerator && C: && python test.py --name fmb_to_fcb --dataroot ./datasets/fmb_to_fcb/ --no_instance --label_nc 0 --loadSize 1000 --fineSize 1000 --resize_or_crop none --how_many 1 --gpu_ids -1")
        shutil.copy(r'C:\\AIStructureGenerator\\results\\fmb_to_fcb\\test_latest\\images\\test_synthesized_image.jpg', r'C:\\AIStructureGenerator\\datasets\\fcb_to_fc2_1to7\\test_A\\test.jpg')
        shutil.copy(r'C:\\AIStructureGenerator\\results\\fmb_to_fcb\\test_latest\\images\\test_synthesized_image.jpg', r'C:\\AIStructureGenerator\\results\\result_bou.jpg')
        os.system("cd C:\\AIStructureGenerator && C: && python test.py --name fcb_to_fc2_1to7 --dataroot ./datasets/fcb_to_fc2_1to7/ --no_instance --label_nc 0 --loadSize 1000 --fineSize 1000 --resize_or_crop none --how_many 1 --gpu_ids -1")
        shutil.copy(r'C:\\AIStructureGenerator\\results\\fcb_to_fc2_1to7\\test_latest\\images\\test_synthesized_image.jpg', r'C:\\AIStructureGenerator\\results\\result_mp.jpg')
    elif type=="DamselflyWings":
        os.system("cd C:\\AIStructureGenerator && C: && python test.py --name Damselfly_1 --dataroot ./datasets/Damselfly_1/ --no_instance --label_nc 0 --loadSize 1000 --fineSize 1000 --resize_or_crop none --how_many 1 --gpu_ids -1")
        shutil.copy(r'C:\\AIStructureGenerator\\results\\Damselfly_1\\test_latest\\images\\test_synthesized_image.jpg', r'C:\\AIStructureGenerator\\datasets\\Damselfly_2\\test_A\\test.jpg')
        shutil.copy(r'C:\\AIStructureGenerator\\results\\Damselfly_1\\test_latest\\images\\test_synthesized_image.jpg', r'C:\\AIStructureGenerator\\results\\result_bou.jpg')
        os.system("cd C:\\AIStructureGenerator && C: && python test.py --name Damselfly_2 --dataroot ./datasets/Damselfly_2/ --no_instance --label_nc 0 --loadSize 1000 --fineSize 1000 --resize_or_crop none --how_many 1 --gpu_ids -1")
        shutil.copy(r'C:\\AIStructureGenerator\\results\\Damselfly_2\\test_latest\\images\\test_synthesized_image.jpg', r'C:\\AIStructureGenerator\\results\\result.jpg')
    elif type=="GrasshopperWings":
        os.system("cd C:\\AIStructureGenerator && C: && python test.py --name GH_1 --dataroot ./datasets/GH_1/ --no_instance --label_nc 0 --loadSize 1000 --fineSize 1000 --resize_or_crop none --how_many 1 --gpu_ids -1")
        shutil.copy(r'C:\\AIStructureGenerator\\results\\GH_1\\test_latest\\images\\test_synthesized_image.jpg', r'C:\\AIStructureGenerator\\datasets\\GH_2\\test_A\\test.jpg')
        shutil.copy(r'C:\\AIStructureGenerator\\results\\GH_1\\test_latest\\images\\test_synthesized_image.jpg', r'C:\\AIStructureGenerator\\results\\result_bou.jpg')
        os.system("cd C:\\AIStructureGenerator && C: && python test.py --name GH_2 --dataroot ./datasets/GH_2/ --no_instance --label_nc 0 --loadSize 1000 --fineSize 1000 --resize_or_crop none --how_many 1 --gpu_ids -1")
        shutil.copy(r'C:\\AIStructureGenerator\\results\\GH_2\\test_latest\\images\\test_synthesized_image.jpg', r'C:\\AIStructureGenerator\\results\\result.jpg')
    elif type=="AmazonWaterLily":
        os.system("cd C:\\AIStructureGenerator && C: && python test.py --name AWL_1 --dataroot ./datasets/AWL_1/ --no_instance --label_nc 0 --loadSize 1000 --fineSize 1000 --resize_or_crop none --how_many 1 --gpu_ids -1")
        shutil.copy(r'C:\\AIStructureGenerator\\results\\AWL_1\\test_latest\\images\\test_synthesized_image.jpg', r'C:\\AIStructureGenerator\\datasets\\AWL_2\\test_A\\test.jpg')
        shutil.copy(r'C:\\AIStructureGenerator\\results\\AWL_1\\test_latest\\images\\test_synthesized_image.jpg', r'C:\\AIStructureGenerator\\results\\result_bou.jpg')
        os.system("cd C:\\AIStructureGenerator && C: && python test.py --name AWL_2 --dataroot ./datasets/AWL_2/ --no_instance --label_nc 0 --loadSize 1000 --fineSize 1000 --resize_or_crop none --how_many 1 --gpu_ids -1")
        shutil.copy(r'C:\\AIStructureGenerator\\results\\AWL_2\\test_latest\\images\\test_synthesized_image.jpg', r'C:\\AIStructureGenerator\\results\\result.jpg')
        
    file_path = 'C:\\AIStructureGenerator\\results\\result.jpg'
# ---------- end generate_force_image_fc2_1to7 ----------
toggle = BooleanToggle(False)  # disabled
generate_force_dragonfly_wing_fc2_1to7_s = Generate_ForceDragonflyWingFc2_1to7Smooth(
    pt=generate_input_image.pt_10,
    pt_3=generate_input_image.pt_8,
    pt_2=generate_input_image.pt_9,
    txt=generate_force_image_fc2_1to7.file_path,
    bool=toggle)  # -> G_4, G, G_2, G_3, G_5; "Generate_Force (Dragonfly Wing) (fc2_1to7) (smooth)"; disabled

number_slider = Slider(0, range=0..1)
# 03 - switch to True - to recognize the image and generate the force geometry
toggle_2 = BooleanToggle(True)
generate_force_dragonfly_wing_fc2_1to7_s_2 = Generate_ForceDragonflyWingFc2_1to7SmoothAirplaneWing(
    pt=generate_input_image.pt_10,
    pt_3=generate_input_image.pt_8,
    pt_2=generate_input_image.pt_9,
    txt=generate_force_image_fc2_1to7.file_path,
    bool=toggle_2,
    num=subtraction)  # -> G_4, G, G_2, G_3, G_5; "Generate_Force (Dragonfly Wing) (fc2_1to7) (smooth) (Airplane Wing)"

# ----
# 03 PREDICTING EDGE LENGTH
# This part 03 can be separately executed without the result from part 02. It only needs an input of the force geometry as described in part 02.
# 01 - input the force geometry
panel_9 = Panel("02 - switch to True")
force_geometry = Curve(generate_force_dragonfly_wing_fc2_1to7_s_2.G_5)
generate_dual = Generate_Dual(crv=force_geometry, bool=Toggle(True))
panel_10 = Panel("03 - switch to True")
generate_ann_input = Generate_ANN_Input(crv=generate_dual, bool=Toggle(True))
panel_11 = Panel("04 - switch to True")
generate_form_length = GhPythonScript(type=select_mode, file_path=generate_ann_input, run=Toggle(True))  # -> out, file_path; inputs run: Boolean
# ---------- generate_form_length: Python ----------
__author__ = "Platina"
__version__ = "2021.07.19"

#encoding=utf-8
import os
import rhinoscriptsyntax as rs
DETACHED_PROCESS = 0x00000010

if run:
    
    os.system("cd C:\\AIStructureGenerator\\ANN && C: && python main.py "+type)
    
    file_path = "C:\\AIStructureGenerator\\ANN\\results.csv"
# ---------- end generate_form_length ----------

pt_2 = Point()
pt_3 = Point()

# ----
# 05 GENERATING FORM
# This part 05 can be separately executed without the result from part 02 and 04. It only needs the result from part 03.
# 01 - input the tolerance of the edge length (default 0.3)
# LCM - length constraint maltiplier
# BCM - boundary constraint magnitude
# 02 - input whether to include the optimization of the edge length
number_slider_2 = Slider(0.3, range=0..10)
number_slider_3 = Slider(10, range=0..10)
number_slider_4 = Slider(0.3, range=0..1)
generate_structural_form = Generate_Structural_Form(
    crv=form_boundary,
    crv_3=generate_dual,
    F=generate_form_length.file_path,
    num_9=panel_2,
    num_2=panel_3,
    num=panel_4,
    bool=Toggle(False),
    pleaserun=Toggle(True),
    pt=pt_2,
    pt_2=pt_3,
    num_3=panel_5)

panel_13 = Panel("[")  # disabled
panel_14 = Panel("[")  # disabled
panel_15 = Panel("]")  # disabled
panel_16 = Panel("]")  # disabled
panel_17 = Panel("form")  # disabled
panel_18 = Panel("json")  # disabled
toggle_3 = BooleanToggle(True)  # disabled

matselect = MaterialSelectionKaramba3D(menu=[dropdown(1), dropdown(1)])
matselect_2 = MaterialSelectionKaramba3D(menu=[dropdown(2), dropdown(1)])
matselect_3 = MaterialSelectionKaramba3D(menu=[dropdown(7), dropdown(1)])
matselect_4 = MaterialSelectionKaramba3D(menu=[dropdown(6), dropdown(1)])
merge_2 = Merge(Data1=matselect, Data2=matselect_2, Data3=matselect_3, Data4=matselect_4)
crv = Curve(scale.Geometry)
item_2 = ListItem(List=merge_2, Index=branch_7, Wrap=True)  # -> Item, Item1, Item2
scale_2 = Scale(Geometry=crv, Center=Point(0, 0, 0), Factor=0.001)  # -> Geometry, Transform
explode = Explode(Curve=scale_2.Geometry, Recursive=True)  # -> Segments, Vertices
item_3 = ListItem(List=explode.Segments, Index=-1, Wrap=True)
panel_19 = Panel("""7.85
0.6
2.5
2.7""")
item_4 = ListItem(List=panel_19, Index=branch_7, Wrap=True)  # -> Item, Item1, Item2
pt_4 = Point([Point(3.513471139, 4.020378454, 0), Point(3.455508526, 3.852988787, 0)])
pt_5 = Point([Point(41.96900722, 2.36208844, 0), Point(41.91511208, 2.228514774, 0)])
settings = SettingsKaramba3D(menu=[dropdown(0)])  # -> AllSettings, GenericOutput
pt_6 = Point(pt_4)
Z = UnitZ(Factor="-9.8067e-5")
loads = LoadsKaramba3D(Vector=Vector(0, 0, -1), LCase="0", mode="Gravity")
loads_2 = LoadsKaramba3D(ForceVector=Z, Local=False, PosInd=pt_6, mode="Point")
load = LoadKaramba3D(flatten(loads))

# ----
# 06 FILES (online tool only)
panel_20 = Panel("_Form_ExternalForces")
layer_ref = LayerReference(ReferenceToggle=generate_structural_form, LayerName=panel_20)  # -> Geometry, Name, UserStrings, GUID
layer_ref_2 = LayerReference(ReferenceToggle=generate_structural_form, LayerName="_Form_InternalLines")  # -> Geometry, Name, UserStrings, GUID
crv_2 = Curve(layer_ref.Geometry)
crv_3 = Curve(layer_ref_2.Geometry)
end = EndPoints(Curve=crv_2)  # -> Start, End
pdecon = Deconstruct(Point=end.Start)  # -> XComponent, YComponent, ZComponent
pdecon_2 = Deconstruct(Point=end.End)  # -> XComponent, YComponent, ZComponent
curvepoint = PointOnCurve(crv_3, parameter=0.5)
subtraction_2 = Subtraction(A=pdecon.XComponent, B=pdecon_2.XComponent)
subtraction_3 = Subtraction(A=pdecon.YComponent, B=pdecon_2.YComponent)
abs = Absolute(Value=subtraction_2)
abs_2 = Absolute(Value=subtraction_3)
smaller = SmallerThan(FirstNumber=abs, SecondNumber=0.01)  # -> SmallerThan, OrEqualTo
smaller_2 = SmallerThan(FirstNumber=abs_2, SecondNumber=0.01)  # -> SmallerThan, OrEqualTo
and = GateAnd(A=smaller.SmallerThan, B=smaller_2.SmallerThan)
not_2 = GateNot(A=and)
cull_2 = CullPattern(List=crv_2, CullPattern=not_2)
merge_3 = Merge(Data1=crv_3, Data2=cull_2)  # -> flatten(Result)
crv_4 = Curve(merge_3)
curvepoint_2 = PointOnCurve(crv_4, parameter=0.5)
toggle_4 = BooleanToggle(True)  # disabled
panel_21 = Panel("output_bake")  # disabled
panel_22 = Panel("done")  # disabled
panel_23 = Panel("txt")  # disabled
toggle_5 = BooleanToggle(True)  # disabled

end_2 = EndPoints(Curve=crv_3)  # -> Start, End; disabled
merge_4 = Merge(Data1=end_2.Start, Data2=end_2.End)  # disabled
duppt = RemoveDuplicatePts(Points=merge_4, Tolerance=0.01)  # disabled
cp = ClosestPoint(Point=end_2.Start, Cloud=duppt)  # -> ClosestPoint, CPIndex, Distance; disabled
cp_2 = ClosestPoint(Point=end_2.End, Cloud=duppt)  # -> ClosestPoint, CPIndex, Distance; disabled
graft = GraftTree(Tree=cp.CPIndex, IncludeEmptyLists=True, IncludeNullItems=True)  # disabled
graft_2 = GraftTree(Tree=cp_2.CPIndex, IncludeEmptyLists=True, IncludeNullItems=True)  # disabled
graft_3 = GraftTree(Tree=duppt, IncludeEmptyLists=True, IncludeNullItems=True)  # disabled
merge_5 = Merge(Data1=graft, Data2=graft_2)  # disabled
pdecon_3 = Deconstruct(Point=graft_3)  # -> XComponent, YComponent, ZComponent; disabled
merge_6 = Merge(Data1=pdecon_3.XComponent, Data2=pdecon_3.YComponent, Data3=pdecon_3.ZComponent)  # -> simplify(Result); disabled
join_2 = TextJoin(Text=merge_6, Join=",")  # disabled
ins = InsertItems(List=join_2, Item=panel_13, Indices=0, Wrap=True)  # disabled
join_3 = TextJoin(Text=merge_5, Join=",")  # disabled
ins_2 = InsertItems(List=join_3, Item=panel_14, Indices=0, Wrap=True)  # disabled
ins_3 = InsertItems(List=ins, Item=panel_15, Indices=-1, Wrap=True)  # disabled
ins_4 = InsertItems(List=ins_2, Item=panel_16, Indices=-1, Wrap=True)  # disabled
join_4 = TextJoin(Text=ins_3)  # -> flatten(Result); disabled
join_5 = TextJoin(Text=ins_4)  # -> flatten(Result); disabled
python = GhPythonScript(x=join_4, y=join_5)  # -> out, a; inputs x: list, y: list; disabled
# ---------- python: Python ----------
__author__ = "psl"
__version__ = "2022.03.28"

import rhinoscriptsyntax as rs

print("{")

print('"edges": {')
for i in range(len(y)):
    print('"'+str(i)+'": '+y[i]+',')
print('}')

print('"vertices": {')
for i in range(len(x)):
    print('"'+str(i)+'": '+x[i]+',')
print('}')
print('}')
# ---------- end python ----------
panel_24 = Panel(python.out)  # disabled
txt_2 = Text(panel_24)  # disabled
python_2 = FileCreator(name=panel_17, ext=panel_18, lines=txt_2, write=toggle_3)  # inputs lines: list, write: Boolean; disabled
# ---------- python_2: Python ----------
"""
Creates a file with a given ndame and extension.
    Inputs:
        name: Desired file name.
        ext: Desired file extension.
        lines: Text to write.
        write: Set to True to write.
"""

# Stephen P. Maher /  2015

ghenv.Component.Name = "File Creator"

import Grasshopper as gh
import os

gh_path = ghdoc.Path # Get GH file path
file = os.path.dirname(os.path.realpath(gh_path)) # Get GH file directory to save to

if "." not in ext: ext = "." + ext
else: pass

#if os.path.exists(file) == False: # Test if file already exists; if it doesn't, proceed
file = name + ext # Set file name and extension
#if os.path.exists(file) == True: # If it does exists, follow the next steps
#    file_count = len([f for f in os.walk(".").next()[2] if f[-4:] == ext]) # Find all files with the same extension
#    file = name + "_" + str(file_count) + ext # Add the number to the new file name as a differentiator

if write:
    filePath = open(file, "w") # Open the file
    for line in lines: # Iterate through lines
        filePath.write(line + "\n") # Write separate lines
    filePath.close() # Close the file
else:
    msg = "Set 'write' to True."
    ghenv.Component.AddRuntimeMessage(gh.Kernel.GH_RuntimeMessageLevel.Warning, msg)
# ---------- end python_2 ----------

crv_5 = Curve(crv_3)
scale_3 = Scale(Geometry=crv_5, Center=Point(0, 0, 0), Factor=0.001)  # -> Geometry, Transform
crv_6 = Curve(scale_3.Geometry)
end_3 = EndPoints(Curve=crv_6)  # -> Start, End
merge_7 = Merge(Data1=end_3.Start, Data2=end_3.End)
duppt_2 = RemoveDuplicatePts(Points=merge_7, Tolerance=0.01)  # -> flatten(UniquePoints)
hull = ConvexHull(Points=duppt_2, Plane=PlaneXY(0, 0, 0))  # -> Hull, HullZ, Indices
explode_2 = Explode(Curve=hull.Hull, Recursive=True)  # -> Segments, Vertices
crv_cp = CurveClosestPoint(Point=duppt_2, Curve=item_3)  # -> Point, Parameter, Distance
len = Length(Curve=crv_6)
graft_4 = GraftTree(Tree=explode_2.Vertices, IncludeEmptyLists=True, IncludeNullItems=True)
smaller_3 = SmallerThan(FirstNumber=crv_cp.Distance, SecondNumber=0.03)  # -> SmallerThan, OrEqualTo
sort = SortList(Keys=crv_cp.Distance, ValuesA=duppt_2)  # -> Keys, ValuesA
cull_3 = CullPattern(List=duppt_2, CullPattern=smaller_3.SmallerThan)
item_5 = ListItem(List=sort.ValuesA, Index=0, Wrap=True)
cir = Circle(Plane=cull_3, Radius=0.1)
merge_8 = Merge(Data1=item_5, Data2=cull_3)  # -> flatten(Result)
duppt_3 = RemoveDuplicatePts(Points=merge_8, Tolerance=0.01)

# ---- group: Reference Geometry
pt_7 = Point(duppt_3)

crv_7 = Curve(crv_6)

# ----
python_3 = GhPythonScript(pleaserun=generate_structural_form)  # -> out, linestemp, edgetemp, facetemp, facebrep; inputs pleaserun: Boolean
# ---------- python_3: Python ----------
__author__ = "Platina"
__version__ = "2019.12.15"

import rhinoscriptsyntax as rs
import scriptcontext as sc
import Rhino
import ghpythonlib.treehelpers as ghtree
import math
import ghpythonlib.components as gh

import clr
import os
import time
clr.AddReferenceToFileAndPath("C:\\PolyFramework\\PolyFramework.dll")

import Rhino.Geometry as rg
import PolyFramework as pf

if pleaserun:
    linestemp = []
    edgetemp = []
    facetemp = []
    facebrep = []
    rs.Command("_SelAll")
    primal = pf.PFoam()
    dual = pf.PFoam()
    containerType = pf.ContainerType
    multiData = pf.LoadData.LoadPrimalDual(True)
    guids = multiData[0]
    primal = multiData[1]
    dual = multiData[2]
    containerType = multiData[3]
    for edge in primal.Edges:
        if (edge.Dual) and (edge.Id>=0):
            if (edge.GetLength()>0) and (edge.Dual.Area>0):
                linestemp.append(edge.CreateLine())
                edgelength = edge.GetLength()
                edgetemp.append(edge.GetLength())
                facearea = edge.Dual.Area
                facetemp.append(edge.Dual.Area)
                facebrep.append(edge.Dual.CreateBrep())
# ---------- end python_3 ----------
debrep = DeconstructBrep(Brep=python_3.facebrep)  # -> Faces, Edges, Vertices
curvepoint_3 = PointOnCurve(debrep.Edges, parameter=0.5)
lng = ListLength(List=crv_3)
lng_2 = ListLength(List=cull_2)
subtraction_4 = Subtraction(A=lng, B=1)
pdecon_4 = Deconstruct(Point=curvepoint_3)  # -> XComponent, YComponent, ZComponent
dom = ConstructDomain(DomainStart=0, DomainEnd=subtraction_4)
dup = DuplicateData(Data="-1", Number=lng_2, Order=True)
sort_2 = SortList(Keys=pdecon_4.ZComponent, ValuesA=debrep.Edges)  # -> Keys, ValuesA
crv_8 = Curve(crv_4)
item_6 = ListItem(List=sort_2.ValuesA, Index=0, Wrap=True)  # -> flatten(Item)
end_4 = EndPoints(Curve=crv_8)  # -> Start, End
merge_9 = Merge(Data1=end_4.Start, Data2=end_4.End)
duppt_4 = RemoveDuplicatePts(Points=merge_9, Tolerance=0.01)
cp_3 = ClosestPoint(Point=end_4.Start, Cloud=duppt_4)  # -> ClosestPoint, CPIndex, Distance
cp_4 = ClosestPoint(Point=end_4.End, Cloud=duppt_4)  # -> ClosestPoint, CPIndex, Distance
lng_3 = ListLength(List=duppt_4)
pdecon_5 = Deconstruct(Point=duppt_4)  # -> XComponent, YComponent, ZComponent
graft_5 = GraftTree(Tree=pdecon_5.XComponent, IncludeEmptyLists=True, IncludeNullItems=True)
graft_6 = GraftTree(Tree=pdecon_5.YComponent, IncludeEmptyLists=True, IncludeNullItems=True)
python_4 = GhPythonScript(spt=cp_3.CPIndex, ept=cp_4.CPIndex, n=lng_3)  # -> out, a, b, c; inputs spt: list of Int32, ept: list of Int32, n: Int32
# ---------- python_4: Python ----------
__author__ = "psl"
__version__ = "2022.04.01"

import rhinoscriptsyntax as rs
import ghpythonlib.treehelpers as ghtree

a = [[] for i in range(n)]
b = [[] for i in range(n)]
c = [[] for i in range(n)]

for i in range(len(spt)):
    a[spt[i]].append(ept[i])
    a[ept[i]].append(spt[i])
    b[spt[i]].append(len(a[ept[i]])-1)
    b[ept[i]].append(len(a[spt[i]])-1)
    c[spt[i]].append(i)
    c[ept[i]].append(i)

a = ghtree.list_to_tree(a)
b = ghtree.list_to_tree(b)
c = ghtree.list_to_tree(c)
# ---------- end python_4 ----------
merge_10 = Merge(Data1=graft_5, Data2=graft_6)
join_6 = TextJoin(Text=python_4.b, Join=",")  # -> flatten(Result)
join_7 = TextJoin(Text=python_4.a, Join=",")  # -> flatten(Result)
join_8 = TextJoin(Text=python_4.c, Join=",")  # -> flatten(Result)
join_9 = TextJoin(Text=merge_10, Join=",")  # -> flatten(Result)

crv_9 = Curve(python_3.linestemp)
curvepoint_4 = PointOnCurve(crv_9, parameter=0.5)
cp_5 = ClosestPoint(Point=curvepoint, Cloud=curvepoint_4)  # -> ClosestPoint, CPIndex, Distance
cp_6 = ClosestPoint(Point=curvepoint_2, Cloud=curvepoint_4)  # -> ClosestPoint, CPIndex, Distance
item_7 = ListItem(List=python_3.facetemp, Index=cp_5.CPIndex, Wrap=True)
sort_3 = SortList(Keys=item_7)  # -> Keys, ValuesA
item_8 = ListItem(List=sort_3.Keys, Index=0, Wrap=True)  # -> Item1, Item
dom_2 = ConstructDomain(DomainStart=item_8.Item, DomainEnd=item_8.Item1)
remap = RemapNumbers(Value=item_7, Source=dom_2, Target="2 to 20")  # -> Mapped, Clipped
pipe = Pipe(Curve=crv_3, Radius=remap.Mapped, Caps=2)  # -> flatten(Pipe); disabled
lng_4 = ListLength(List=pipe)  # disabled
python_5 = GhPythonScript(run=toggle_4, geo=pipe, name=panel_21)  # -> out, Form_InternalLines; inputs run: Boolean, geo: list of Brep; disabled
# ---------- python_5: Python ----------
__author__ = "Hao"
__version__ = "2018.1.28"


import rhinoscriptsyntax as rs
import scriptcontext as sc
import Rhino
import ghpythonlib.treehelpers as ghtree
import math
import ghpythonlib.components as gh

import clr
import os
import time
clr.AddReferenceToFileAndPath("C:\\PolyFramework\\PolyFramework.dll")

import Rhino.Geometry as rg
import PolyFramework as pf

if run:
    
    sc.doc = Rhino.RhinoDoc.ActiveDoc
    rhdoc = Rhino.RhinoDoc.ActiveDoc
    
    rs.AddLayer("_Pipes")
    a = rs.ObjectsByLayer("_Pipes")
    rs.DeleteObjects(a)
    
    rl = Rhino.DocObjects.ObjectAttributes()
    rl.LayerIndex = rhdoc.Layers.FindName("_Pipes").Index
    for geoi in geo:
        rhdoc.Objects.Add(geoi,rl)
    
    stl_fullname = name+'.stl'
    stl_path = rs.DocumentPath()
    full_filepath = os.path.join(stl_path,stl_fullname)
    command_string = '-_Export "{}" _Enter _Enter'.format(full_filepath)
    
    rs.Command("_SelLayerNumber "+str(rhdoc.Layers.FindName("_Pipes").Index))
    
    rs.Command(command_string)
    #rs.Command("-_Export \\output.stl _Enter _Enter")
# ---------- end python_5 ----------
division_2 = Division(A=lng_4, B=lng_4)  # disabled
txt_3 = Text(division_2)  # disabled
python_6 = FileCreator(name=panel_22, ext=panel_23, lines=txt_3, write=toggle_5)  # inputs lines: list, write: Boolean; disabled; same code as python_2

num_2 = Number(remap.Mapped)
multiplication = Multiplication(A=num_2, B=0.1)
multiplication_2 = Multiplication(A=num_2, B=0.001)
multiplication_3 = Multiplication(A=multiplication, B=2)
sqr = Square(Value=multiplication_2)
multiplication_4 = Multiplication(A=sqr, B=3.141592654)
dist = Distance(PointA=graft_4, PointB=pt_7)
multiplication_5 = Multiplication(A=multiplication_4, B=len)
sort_4 = SortList(Keys=dist)  # -> Keys, ValuesA
item_9 = ListItem(List=sort_4.Keys, Index=-1, Wrap=True)  # -> flatten(Item)
ma = MassAddition(Input=multiplication_5)  # -> Result, PartialResults
sort_5 = SortList(Keys=item_9, ValuesA=explode_2.Vertices)  # -> Keys, ValuesA
item_10 = ListItem(List=sort_5.Keys, Index=-1, Wrap=True)
item_11 = ListItem(List=sort_5.ValuesA, Index=-1, Wrap=True)
pt_8 = Point(item_11)
lng_5 = ListLength(List=crv_7)
multiplication_6 = Multiplication(A=ma.Result, B=item_4.Item)
multiplication_7 = Multiplication(A=multiplication_6, B=9.8)
series = Series(Start=0, Step=1, Count=lng_5)
neg = Negative(Value=multiplication_7)
txt_4 = Text(series)
graft_7 = GraftTree(Tree=txt_4, IncludeEmptyLists=True, IncludeNullItems=True)
ins_5 = InsertItems(List=graft_7, Item="A", Indices=0, Wrap=True)
join_10 = TextJoin(Text=ins_5)  # -> flatten(Result)
division_3 = Division(A=neg, B=2)
cross_section = CrossSectionKaramba3D(
    FamilyNameOfCrossSection="DefaultCroSec",
    ElementIdentifier=join_10,
    Material=item_2.Item,
    Diameter_cm=multiplication_3,
    WallThickness_cm=multiplication,
    mode="Circular Hollow")
Z_2 = UnitZ(Factor=division_3)
loads_3 = LoadsKaramba3D(ForceVector=Z_2, Local=False, PosInd=pt_8, mode="Point")
load_2 = LoadKaramba3D(flatten(loads_3))
multiplication_8 = Multiplication(A=item_10, B=1000)

# ---- group: Define Elements
linetobeam = LineToBeamKaramba3D(
    Line=crv_7,
    Identifier=join_10,
    CrossSection=cross_section,
    New=True,
    Remove=True,
    LimitDistance_m=0.005,
    Bending=Toggle(True))  # -> Element, Points, Info

# ---- group: Reference Geometry
pt_9 = Point(linetobeam.Points)

# ---- group: Define Supports
fsim = FindSimilarMember(Data=pt_7, Set=linetobeam.Points)  # -> Hit, Index
cull_i = CullIndex(List=linetobeam.Points, Indices=fsim.Index, Wrap=True)
supp = SupportKaramba(PosInd=pt_7, menu=[buttons(on, on, on, on, on, on)])
supp_2 = SupportKaramba(PosInd=cull_i, menu=[buttons(off, on, off, on, off, on)])
support = SupportKaramba(flatten(supp))

# ---- group: Assemble Model
assemble = AssembleModelKaramba(
    Elem=linetobeam.Element,
    Support=support,
    Load=load,
    CrossSection=cross_section,
    Material=item_2.Item,
    LimitDistance_m=0.005)  # -> Model, Info, Mass_kg, CenterOfGravity

assemble_2 = AssembleModelKaramba(Elem=linetobeam.Element, Support=support, Load=load_2, LimitDistance_m=0.005)  # -> Model, Info, Mass_kg, CenterOfGravity

# ---- group: Analyze Model
analyze = AnalyzeKaramba3D(Model=assemble.Model)  # -> CalculatedModel, MaximumDisplacement_cm, ResultingForceOfGravity_kN, ElasticEnergy_kNm
displacement = Panel(analyze.MaximumDisplacement_cm)

analyze_2 = AnalyzeKaramba3D(Model=assemble_2.Model)  # -> CalculatedModel, MaximumDisplacement_cm, ResultingForceOfGravity_kN, ElasticEnergy_kNm
displacement_2 = Panel(analyze_2.MaximumDisplacement_cm)

# ---- group: View Results
modelview = ModelViewKaramba3D(Model=analyze.CalculatedModel, LoadCaseFactorsForLinearSuperposition=1, IndexOfVisibleLoadcase=-1)  # -> Model, DeformedMesh, DeformedAxes, DeformedModel
beamview = BeamViewKaramba3D(Model=modelview.Model)  # -> Model, MeshesOfRenderedBeams, DeformedBeamAxes, LegendColors, LegendTags
legend = Legend(Colour=beamview.LegendColors, Tags=beamview.LegendTags, LegendType=1)

modelview_2 = ModelViewKaramba3D(Model=analyze_2.CalculatedModel, LoadCaseFactorsForLinearSuperposition=1, IndexOfVisibleLoadcase=-1)  # -> Model, DeformedMesh, DeformedAxes, DeformedModel
beamview_2 = BeamViewKaramba3D(Model=modelview_2.Model)  # -> Model, MeshesOfRenderedBeams, DeformedBeamAxes, LegendColors, LegendTags
legend_2 = Legend(Colour=beamview_2.LegendColors, Tags=beamview_2.LegendTags, LegendType=1)

# ----
panel_25 = Panel(linetobeam.Points)
crv_10 = Curve(modelview.DeformedAxes)
crv_11 = Curve(modelview_2.DeformedAxes)
scale_4 = Scale(Geometry=crv_10, Center=Point(0, 0, 0), Factor=1000)  # -> Geometry, Transform
scale_5 = Scale(Geometry=crv_11, Center=Point(0, 0, 0), Factor=1000)  # -> Geometry, Transform
crv_12 = Curve(scale_5.Geometry)
end_5 = EndPoints(Curve=scale_4.Geometry)  # -> Start, End
lng_6 = ListLength(List=scale_4.Geometry)
end_6 = EndPoints(Curve=crv_12)  # -> Start, End
ln = Line(StartPoint=end_5.Start, EndPoint=end_5.End)
lng_7 = ListLength(List=crv_12)
ln_2 = Line(StartPoint=end_6.Start, EndPoint=end_6.End)
end_7 = EndPoints(Curve=ln)  # -> Start, End
end_8 = EndPoints(Curve=ln_2)  # -> Start, End
pdecon_6 = Deconstruct(Point=end_7.Start)  # -> XComponent, YComponent, ZComponent
pdecon_7 = Deconstruct(Point=end_7.End)  # -> XComponent, YComponent, ZComponent
pdecon_8 = Deconstruct(Point=end_8.Start)  # -> XComponent, YComponent, ZComponent
pdecon_9 = Deconstruct(Point=end_8.End)  # -> XComponent, YComponent, ZComponent
graft_8 = GraftTree(Tree=pdecon_7.ZComponent, IncludeEmptyLists=True, IncludeNullItems=True)
graft_9 = GraftTree(Tree=pdecon_6.ZComponent, IncludeEmptyLists=True, IncludeNullItems=True)
graft_10 = GraftTree(Tree=pdecon_9.ZComponent, IncludeEmptyLists=True, IncludeNullItems=True)
graft_11 = GraftTree(Tree=pdecon_8.ZComponent, IncludeEmptyLists=True, IncludeNullItems=True)
merge_11 = Merge(Data1=graft_9, Data2=graft_8)
merge_12 = Merge(Data1=graft_11, Data2=graft_10)
sort_6 = SortList(Keys=merge_11)  # -> Keys, ValuesA
sort_7 = SortList(Keys=merge_12)  # -> Keys, ValuesA
item_12 = ListItem(List=sort_6.Keys, Index=1, Wrap=True)  # -> flatten(Item)
item_13 = ListItem(List=sort_7.Keys, Index=1, Wrap=True)  # -> flatten(Item)
bnd = Bounds(Numbers=item_12)
bnd_2 = Bounds(Numbers=item_13)
dedomain = DeconstructDomain(Domain=bnd)  # -> Start, End
gradient = Gradient(
    LowerLimit=dedomain.Start,
    UpperLimit=dedomain.End,
    Parameter=item_12,
    stops=[0: RGB(234, 38, 0), 0.25: RGB(234, 126, 0), 0.5: RGB(254, 244, 84), 0.75: RGB(173, 203, 249), 1: RGB(75, 107, 169)])
dedomain_2 = DeconstructDomain(Domain=bnd_2)  # -> Start, End
gradient_2 = Gradient(
    LowerLimit=dedomain_2.Start,
    UpperLimit=dedomain_2.End,
    Parameter=item_13,
    stops=[0: RGB(234, 38, 0), 0.25: RGB(234, 126, 0), 0.5: RGB(254, 244, 84), 0.75: RGB(173, 203, 249), 1: RGB(75, 107, 169)])
argb = SplitARGB(Colour=gradient)  # -> Alpha, Red, Green, Blue
argb_2 = SplitARGB(Colour=gradient_2)  # -> Alpha, Red, Green, Blue
multiplication_9 = Multiplication(A=argb.Red, B=255)
multiplication_10 = Multiplication(A=argb.Green, B=255)
multiplication_11 = Multiplication(A=argb.Blue, B=255)
multiplication_12 = Multiplication(A=argb_2.Red, B=255)
multiplication_13 = Multiplication(A=argb_2.Green, B=255)
multiplication_14 = Multiplication(A=argb_2.Blue, B=255)
merge_13 = Merge(
    Data1=simplify(graft(pdecon_6.XComponent)),
    Data2=simplify(graft(pdecon_6.YComponent)),
    Data3=simplify(graft(pdecon_6.ZComponent)),
    Data4=simplify(graft(pdecon_7.XComponent)),
    Data5=simplify(graft(pdecon_7.YComponent)),
    Data6=simplify(graft(pdecon_7.ZComponent)),
    Data7=simplify(graft(multiplication_9)),
    Data8=simplify(graft(multiplication_10)),
    Data9=simplify(graft(multiplication_11)))
merge_14 = Merge(Data1=flatten(lng_6), Data2=flatten(dedomain.End), Data3=flatten(dedomain.Start), Data4=flatten(multiplication_8))
merge_15 = Merge(
    Data1=simplify(graft(pdecon_8.XComponent)),
    Data2=simplify(graft(pdecon_8.YComponent)),
    Data3=simplify(graft(pdecon_8.ZComponent)),
    Data4=simplify(graft(pdecon_9.XComponent)),
    Data5=simplify(graft(pdecon_9.YComponent)),
    Data6=simplify(graft(pdecon_9.ZComponent)),
    Data7=simplify(graft(multiplication_12)),
    Data8=simplify(graft(multiplication_13)),
    Data9=simplify(graft(multiplication_14)))
merge_16 = Merge(Data1=flatten(lng_7), Data2=flatten(dedomain_2.End), Data3=flatten(dedomain_2.Start), Data4=flatten(multiplication_8))
join_11 = TextJoin(Text=merge_14, Join=",")  # -> flatten(Result)
join_12 = TextJoin(Text=merge_13, Join=",")  # -> flatten(Result)
join_13 = TextJoin(Text=merge_16, Join=",")  # -> flatten(Result)
join_14 = TextJoin(Text=merge_15, Join=",")  # -> flatten(Result)
merge_17 = Merge(Data1=join_11, Data2=join_12)
merge_18 = Merge(Data1=join_13, Data2=join_14)
merge_19 = Merge(Data1=merge_17, Data2=merge_18)

# ---- group: Check Beam Internal Forces
b_forces = BeamForcesKaramba(AnalyzedModel=analyze.CalculatedModel, LCase=-1, MaximumDistanceBetweenResults_m=-1, NumberOfResultsPerBeamElement="3")  # -> AnalyzedModel, NormalForce_kN, ShearForceVz_kN, ShearForceVy_kN, BendingMomentMt_kNm, BendingMomentMy_kNm, BendingMomentMz_kNm
panel_26 = Panel(b_forces.NormalForce_kN)

# ---- group: Check Beam Displacements
beamdisp = BeamDisplacementsKaramba(AnalyzedModel=analyze.CalculatedModel, LoadCase=-1, MaximumDistanceBetweenResults_ft=-1, NumberOfResultsPerElement="3")  # -> AnalyzedModel, simplify(Translations_ft), Rotations_rad
panel_27 = Panel(beamdisp.Translations_ft)

# ---- group: Check Beam Internal Forces
b_forces_2 = BeamForcesKaramba(AnalyzedModel=analyze_2.CalculatedModel, LCase=-1, MaximumDistanceBetweenResults_m=-1, NumberOfResultsPerBeamElement="3")  # -> AnalyzedModel, NormalForce_kN, ShearForceVz_kN, ShearForceVy_kN, BendingMomentMt_kNm, BendingMomentMy_kNm, BendingMomentMz_kNm
panel_28 = Panel(b_forces_2.NormalForce_kN)

# ---- group: Check Beam Displacements
beamdisp_2 = BeamDisplacementsKaramba(AnalyzedModel=analyze_2.CalculatedModel, LoadCase=-1, MaximumDistanceBetweenResults_ft=-1, NumberOfResultsPerElement="3")  # -> AnalyzedModel, simplify(Translations_ft), Rotations_rad
panel_29 = Panel(beamdisp_2.Translations_ft)

# ----
end_9 = EndPoints(Curve=cull_2)  # -> Start, End
end_10 = EndPoints(Curve=crv_3)  # -> Start, End
merge_20 = Merge(Data1=end_10.Start, Data2=end_10.End)
duppt_5 = RemoveDuplicatePts(Points=merge_20, Tolerance=0.01)
cp_7 = ClosestPoint(Point=end_9.End, Cloud=duppt_5)  # -> ClosestPoint, CPIndex, Distance
cp_8 = ClosestPoint(Point=end_9.Start, Cloud=duppt_5)  # -> ClosestPoint, CPIndex, Distance
larger = LargerThan(FirstNumber=cp_8.Distance, SecondNumber=cp_7.Distance)  # -> LargerThan, OrEqualTo
graft_12 = GraftTree(Tree=larger.LargerThan, IncludeEmptyLists=True, IncludeNullItems=True)
end_11 = EndPoints(Curve=crv_3)  # -> Start, End
flip = FlipCurve(Curve=cull_2)  # -> Curve, Flag
pdecon_10 = Deconstruct(Point=end_11.End)  # -> XComponent, YComponent, ZComponent
pdecon_11 = Deconstruct(Point=end_11.Start)  # -> XComponent, YComponent, ZComponent
graft_13 = GraftTree(Tree=flip.Curve, IncludeEmptyLists=True, IncludeNullItems=True)
graft_14 = GraftTree(Tree=cull_2, IncludeEmptyLists=True, IncludeNullItems=True)
merge_21 = Merge(Data1=graft_13, Data2=graft_14)
item_14 = ListItem(List=merge_21, Index=graft_12, Wrap=True)  # -> flatten(Item)
bnd_3 = Bounds(Numbers=remap.Mapped)
end_12 = EndPoints(Curve=item_14)  # -> Start, End
pdecon_12 = Deconstruct(Point=end_12.End)  # -> XComponent, YComponent, ZComponent
pdecon_13 = Deconstruct(Point=end_12.Start)  # -> XComponent, YComponent, ZComponent
remap_2 = RemapNumbers(Value=remap.Mapped, Source=bnd_3, Target="0 to 1")  # -> Mapped, Clipped
merge_22 = Merge(
    Data1=simplify(graft(pdecon_11.XComponent)),
    Data2=simplify(graft(pdecon_11.YComponent)),
    Data3=simplify(graft(pdecon_10.XComponent)),
    Data4=simplify(graft(pdecon_10.YComponent)),
    Data5=simplify(graft(remap_2.Mapped)))
join_15 = TextJoin(Text=merge_22, Join=",")  # -> flatten(Result)
merge_23 = Merge(
    Data1=simplify(graft(pdecon_13.XComponent)),
    Data2=simplify(graft(pdecon_13.YComponent)),
    Data3=simplify(graft(pdecon_12.XComponent)),
    Data4=simplify(graft(pdecon_12.YComponent)))
ins_6 = InsertItems(List=merge_23, Item="-1", Indices=-1, Wrap=True)
join_16 = TextJoin(Text=ins_6, Join=",")  # -> flatten(Result)
merge_24 = Merge(Data1=join_15, Data2=join_16)
lng_8 = ListLength(List=merge_24)
txt_5 = Text(merge_24)

item_15 = ListItem(List=item_6, Index=cp_6.CPIndex, Wrap=True)
project = Project(Geometry=item_15, Plane=PlaneXY(0, 0, 0))  # -> Geometry, Transform
len_2 = Length(Curve=project.Geometry)
subset = SubList(List=len_2, Domain=dom, Wrap=True)  # -> List, Index
bnd_4 = Bounds(Numbers=subset.List)
remap_3 = RemapNumbers(Value=subset.List, Source=bnd_4, Target="0 to 1")  # -> Mapped, Clipped
end_13 = EndPoints(Curve=project.Geometry)  # -> Start, End
merge_25 = Merge(Data1=flatten(remap_3.Mapped), Data2=flatten(dup))
pdecon_14 = Deconstruct(Point=end_13.Start)  # -> XComponent, YComponent, ZComponent
pdecon_15 = Deconstruct(Point=end_13.End)  # -> XComponent, YComponent, ZComponent
lng_9 = ListLength(List=project.Geometry)
graft_15 = GraftTree(Tree=pdecon_14.XComponent, IncludeEmptyLists=True, IncludeNullItems=True)
graft_16 = GraftTree(Tree=pdecon_14.YComponent, IncludeEmptyLists=True, IncludeNullItems=True)
graft_17 = GraftTree(Tree=pdecon_15.XComponent, IncludeEmptyLists=True, IncludeNullItems=True)
graft_18 = GraftTree(Tree=pdecon_15.YComponent, IncludeEmptyLists=True, IncludeNullItems=True)
merge_26 = Merge(
    Data1=simplify(graft_15),
    Data2=simplify(graft_16),
    Data3=simplify(graft_17),
    Data4=simplify(graft_18),
    Data5=simplify(graft(merge_25)))
join_17 = TextJoin(Text=merge_26, Join=",")  # -> flatten(Result)
merge_27 = Merge(
    Data1=flatten(lng_8),
    Data2=flatten(txt_5),
    Data3=flatten(lng_3),
    Data4=flatten(join_9),
    Data5=flatten(join_7),
    Data6=flatten(join_6),
    Data7=flatten(join_8),
    Data8=flatten(lng_9),
    Data9=flatten(join_17),
    Data10=flatten(merge_19),
    Data11=flatten(txt))

txt_6 = Text(merge_27)
python_7 = FileCreator(name="output_bake", ext="csv", lines=txt_6, write=Toggle(True))  # inputs lines: list, write: Boolean; same code as python_2
lng_10 = ListLength(List=txt_6)
division_4 = Division(A=lng_10, B=lng_10)
txt_7 = Text(division_4)
python_8 = FileCreator(name="done", ext="txt", lines=txt_7, write=Toggle(True))  # inputs lines: list, write: Boolean; same code as python_2

# ==== cluster Select_mode
G = ClusterInput()
brec = BoundingRectangle(Geometry=G, Plane=PlaneXY(0, 0, 0), Axis=0, Slide=0, Union=True)  # -> Bounding, DimensionX, DimensionY
explode = Explode(Curve=brec.Bounding, Recursive=True)  # -> Segments, Vertices
mode = ClusterInput()
item = ListItem(List=explode.Segments, Index=0, Wrap=True)  # -> Item, Item1
len = Length(Curve=item.Item)
len_2 = Length(Curve=item.Item1)
division = Division(A=len, B=len_2)
select_type = GhPythonScript(ratio=division, mode=mode)  # -> out, type
# ---------- select_type: Python ----------
__author__ = "Platina"
__version__ = "2021.07.24"

import rhinoscriptsyntax as rs
import ghpythonlib.components as gh

a = [1.0,1.8,3.5,4.4]
b = ["AmazonWaterLily","GrasshopperWings","DragonflyWings","DamselflyWings"]

if mode!="AutoMode":
    type = mode
else:
    if ratio<1.4:
        type = "AmazonWaterLily"
    elif ratio<2.65:
        type = "GrasshopperWings"
    elif ratio<3.95:
        type = "DragonflyWings"
    else:
        type = "DamselflyWings"
# ---------- end select_type ----------
type = ClusterOutput(select_type.type)

# ==== cluster Generate_Input_Image
crv = ClusterInput()
run = ClusterInput()
txt = ClusterInput()
crv_2 = Curve(crv)
python = GhPythonScript(run=run)  # -> out, a, b; inputs run: Boolean
# ---------- python: Python ----------
__author__ = "Platina"
__version__ = "2021.07.19"

import rhinoscriptsyntax as rs

if run:
    a = 1024
    b = 512
else:
    a = 0
    b = 0
# ---------- end python ----------
txt_2 = Text(txt)
brec = BoundingRectangle(Geometry=crv_2, Plane=PlaneXY(0, 0, 0), Axis=0, Slide=0, Union=True)  # -> Bounding, DimensionX, DimensionY
drec = DeconstuctRectangle(Rectangle=brec.Bounding)  # -> BasePlane, XInterval, YInterval
dedomain = DeconstructDomain(Domain=drec.YInterval)  # -> Start, End
dedomain_2 = DeconstructDomain(Domain=drec.XInterval)  # -> Start, End
subtraction = Subtraction(A=dedomain.End, B=dedomain.Start)
subtraction_2 = Subtraction(A=dedomain_2.End, B=dedomain_2.Start)
python_2 = GhPythonScript(x=subtraction_2, y=subtraction, z=Slider(1.7, range=0..10))  # -> out, a, b
# ---------- python_2: Python ----------
__author__ = "Platina"
__version__ = "2021.07.19"

import rhinoscriptsyntax as rs

if x>2*y:
    a = x
    b = x/2
else:
    a = 2*y
    b = y

a = a/2*z
b = b/2*z
# ---------- end python_2 ----------
pt = Point(drec.BasePlane)
pdecon = Deconstruct(Point=pt)  # -> XComponent, YComponent, ZComponent
subtraction_3 = Subtraction(A=pdecon.XComponent, B=python_2.a)
subtraction_4 = Subtraction(A=pdecon.YComponent, B=python_2.b)
addition = Addition(A=pdecon.YComponent, B=python_2.b)
addition_2 = Addition(A=pdecon.XComponent, B=python_2.a)
pt_2 = ConstructPoint(XCoordinate=addition_2, YCoordinate=addition, ZCoordinate=0)
pt_3 = ConstructPoint(XCoordinate=subtraction_3, YCoordinate=subtraction_4, ZCoordinate=0)
pdecon_2 = Deconstruct(Point=pt_2)  # -> XComponent, YComponent, ZComponent
pdecon_3 = Deconstruct(Point=pt_3)  # -> XComponent, YComponent, ZComponent
subtraction_5 = Subtraction(A=pdecon_2.YComponent, B=pdecon_3.YComponent)
division = Division(A=subtraction_5, B=6)
addition_3 = Addition(A=pdecon.YComponent, B=division)
pt_4 = ConstructPoint(XCoordinate=pdecon.XComponent, YCoordinate=addition_3, ZCoordinate=pdecon.ZComponent)
addition_4 = Addition(A=pdecon_3.YComponent, B=division)
addition_5 = Addition(A=pdecon_2.YComponent, B=division)
pt_5 = ConstructPoint(XCoordinate=pdecon_3.XComponent, YCoordinate=addition_4, ZCoordinate=pdecon_3.ZComponent)
pt_6 = ConstructPoint(XCoordinate=pdecon_2.XComponent, YCoordinate=addition_5, ZCoordinate=pdecon_2.ZComponent)
multiplication = Multiplication(A=python_2.a, B=2)
multiplication_2 = Multiplication(A=python_2.b, B=2)
xz = XZPlane(Origin=pt_4)
division_2 = Division(A=multiplication, B=1024)
division_3 = Division(A=multiplication_2, B=512)
dom = ConstructDomain(DomainStart=0, DomainEnd=division_3)
dom_2 = ConstructDomain(DomainStart=0, DomainEnd=division_2)
rectangle = Rectangle(Plane=pt_5, XSize=dom_2, YSize=dom, Radius=0)  # -> Rectangle, Length
arrrec = RectangularArray(Geometry=pt_5, Cell=rectangle.Rectangle, XCount=python.a, YCount=python.b)  # -> Geometry, Transform
item = ListItem(List=arrrec.Geometry, Index=1023, Wrap=True)
pt_7 = Point(item)
mirror = Mirror(Geometry=arrrec.Geometry, Plane=xz)  # -> Geometry, Transform
incurve = PointInCurve(Point=mirror.Geometry, Curve=crv_2)  # -> Relationship, Point
python_3 = GhPythonScript(type=txt_2, x=incurve.Relationship)  # -> out, file_path; inputs x: list of Int32
# ---------- python_3: Python ----------
__author__ = "Platina"
__version__ = "2021.07.19"

import rhinoscriptsyntax as rs
import System

a = System.Drawing.Bitmap(512,1024)

count = 0
for i in range(512):
    for j in range(1024):
        if x[count]==2:
            a.SetPixel(i,j,System.Drawing.Color.FromArgb(0,0,0))
        else:
            a.SetPixel(i,j,System.Drawing.Color.FromArgb(255,255,255))
        count += 1

a.RotateFlip(System.Drawing.RotateFlipType.Rotate90FlipX)

file_path = "C:\\AIStructureGenerator\\datasets\\test.jpg"

System.Drawing.Bitmap.Save(a,file_path)

if type=="DragonflyWings":
    file_path = "C:\\AIStructureGenerator\\datasets\\fmb_to_fcb\\test_A\\test.jpg"
elif type=="DamselflyWings":
    file_path = "C:\\AIStructureGenerator\\datasets\\Damselfly_1\\test_A\\test.jpg"
elif type=="GrasshopperWings":
    file_path = "C:\\AIStructureGenerator\\datasets\\GH_1\\test_A\\test.jpg"
elif type=="AmazonWaterLily":
    file_path = "C:\\AIStructureGenerator\\datasets\\AWL_1\\test_A\\test.jpg"

System.Drawing.Bitmap.Save(a,file_path)
# ---------- end python_3 ----------
file_path = ClusterOutput(python_3.file_path)
pt_8 = ClusterOutput(pt_7)
pt_9 = ClusterOutput(pt_6)
pt_10 = ClusterOutput(pt_5)

# ==== cluster Generate_Dual
crv = ClusterInput()
crv_2 = Curve(crv)
explode = Explode(Curve=crv_2, Recursive=True)  # -> flatten(Segments), Vertices
dupln = RemoveDuplicateLines(Lines=explode.Segments, Tolerance=0.01)
crv_3 = Curve(dupln)

grid_divisions = Integer(20)
crv_4 = Curve(simplify(crv_3))
x_bounds = Domain(Domain(1950, 3650))
y_bounds = Domain(Domain(2750, 3550))

dom² = Domain²(DomainU=x_bounds, DomainV=y_bounds)
hem_open_xy_networks = VBScript(seg=crv_4, bnd=dom², sbdv=grid_divisions)  # -> out, flatten(e), flatten(eOV), flatten(ePE), flatten(eNE), flatten(eTE), flatten(eIF), flatten(v)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; inputs seg: list of Curve
# ---------- hem_open_xy_networks: VB ----------
    Dim edgeList As New list(Of Line)
    Dim eOVlist As New dataTree(Of int32)
    Dim ePElist As New dataTree(Of int32)
    Dim eNElist As New dataTree(Of int32)
    Dim eTElist As New list(Of int32)
    Dim eIFlist As New list(Of int32)
    Dim vtxList As New list(Of point3d)
    Dim vIElist As New list(Of int32)
    Dim fList As New datatree(Of point3d)
    Dim fIElist As New dataTree(Of int32)

    Dim vIEall As New dataTree(Of int32)
    Dim eF As New list(Of Boolean)

    Dim eDegList As New List(Of Double)

    '********FOR EACH SEGMENT, ADD EDGE AND ITS REVERSE (twin) TO edgeList********
    Dim segCt As int32 = 0
    For i As int32=0 To seg.count - 1
      If seg(i).pointAtStart.distanceto(seg(i).pointAtEnd) > 0 Then
        edgeList.add(New Line(seg(i).pointAtStart, seg(i).pointAtEnd))
        edgeList.add(New Line(seg(i).pointAtEnd, seg(i).pointAtStart))
        eTEList.add((segCt * 2) + 1)
        eTEList.add((segCt * 2))
        'DEFAULT SETTING FOR ef IS TRUE (ie EDGE NEEDS TO BE ASSIGNED TO A FACE)
        ef.add(True)
        ef.add(True)
        eIFlist.add(-10)
        eIFlist.add(-10)

        EdgeDirection(edgeList(edgeList.count - 2), eDegList)
        segCt += 1
      End If
    Next

    Dim vtxTree As New dataTree(Of point3d)
    Dim vNdxTree As New dataTree(Of Int32)
    For i As int32=0 To sbdv - 1
      For j As int32=0 To sbdv - 1
        vtxTree.ensurepath(New gh_path(i, j))
        vNdxTree.ensurepath(New gh_path(i, j))
      Next
    Next


    '********CONSTRUCT VERTEX LIST FROM LIST OF HALF-EDGES********
    For i As int32=0 To edgeList.count - 1
      'boolCk = (is there a close point?, what is the index)
      Dim boolCk() As int32 = {0,-10}

      Dim vCt As int32 = vtxTree.datacount
      CheckLinePt(edgeList(i), vtxTree, vNdxTree, boolCk, bnd, sbdv, 0)

      'IF A NEW VERTEX WAS ADDED, THEN ADD EDGE INDEX TO vIE, vIEall, AND eOV
      If vtxTree.datacount > vCt Then
        vIElist.add(i)
        vIEall.add(i, New GH_Path(boolCk(1)))
        eOVlist.add(boolCk(1), New GH_Path(i))

      Else If boolCK(1) >= 0 Then
        vIEall.add(i, New GH_Path(boolCK(1)))
        eOVlist.add(boolCK(1), New GH_Path(i))
      End If
    Next



    '********FROM EACH HALF-EDGE..
    For i As int32=0 To edgeList.count - 1
      Dim boolCk() As int32 = {0,-10}
      'FIND VERTEX CORRESPONDING TO ENDPOINT (=boolCk(1))
      CheckLinePt(edgeList(i), vtxTree, vNdxTree, boolCk, bnd, sbdv, 1)

      'boolCk(1)=TARGET VERTEX, CHECK ANGLE OF ALL EDGES LEAVING THIS VERTEX
      Dim nxtVtxPth As New gh_path(boolCk(1))
      Dim angCk As Double = -100
      Dim ndx As int32 = -10
      'Dim xProd As vector3d = vector3d.CrossProduct(edgeList(i).direction, vector3d.ZAxis)



      '..FIND NEXT EDGE********
      For j As int32=0 To vIEall.branch(nxtVtxPth).count - 1
        If i <> eTElist(vIEall(nxtVtxPth, j)) Then
          Dim ang As Double = eDegList(eTElist(i)) - eDegList(vIEall(nxtVtxPth, j))
          If ang < 0 Then ang += 360
          If ang > angCk  Then
            angCk = ang
            ndx = j
          End If
        End If
      Next

      If ndx >= 0 Then
        eNElist.add(vIEall(nxtVtxPth, ndx), New GH_Path(i))
        ePElist.add(i, New GH_Path(vIEall(nxtVtxPth, ndx)))
      Else
        'NO NEXT EDGE FOUND, THEN NEXT EDGE IS TWIN
        angCk = math.PI
        ndx = eTElist(i)
        eNElist.add(eTElist(i), New GH_Path(i))
        ePElist.add(i, New GH_Path(eTElist(i)))
      End If
    Next



    '********FIND EDGE-LOOPS / 'FACES'********
    Dim faceCt As int32 = 0
    For i As int32=0 To edgeList.count - 1
      If ef(i) Then
        fList.add(edgeList(i).pointAt(0), New gh_path(faceCt))
        fIEList.add(i, New gh_path(faceCt))
        eIFlist(i) = faceCt
        ef(i) = False
        loopFace(edgeList, ef, eNElist, eNElist(New GH_Path(i), 0), i, fIElist, fList, eIFlist, faceCt)
        faceCt += 1
      End If
    Next


    '********CONVERT vtxTree (SORTED IN BRANCHES BY LOCATION IN GRID)TO LIST (IN ORDER OF INDEX VALUE)********
    For i As int32=0 To vtxTree.datacount - 1
      vtxList.add(Nothing)
    Next
    For i As int32=0 To vtxTree.datacount - 1
      Dim sortNdx As int32 = vNdxTree.alldata(i)
      vtxList(sortNdx) = vtxTree.alldata(i)
    Next

    e = edgeList
    eOV = eOVlist
    eNE = eNElist
    ePE = ePElist
    eTE = eTElist
    eIF = eIFlist
    v = vtxList ' vtxTree
    vIE = vIEall
    f = fList
    fIE = fIElist

    '********PRINT HEM STATS********
    print(vtxList.count & " vertices")
    print(faceCt & " faces")
    print(edgeList.count & " ½ edges")
# ---------- hem_open_xy_networks: VB additional code ----------
  Sub CheckLinePt(ByVal eCurr As Line, ByRef vTree As datatree(Of point3d), ByRef nTree As datatree (Of int32), ByRef ck As Array, ByVal dom As UVInterval, ByVal div As int32, ByVal t As Double)
    'WHEN t=0: CHECKING START POINT; WHEN t=1: CHECKING END POINT
    Dim ptCk As New point3d(eCurr.PointAt(t))

    'POINT VALUE (MINUS DOMAIN STARTING POINT) DIVIDED BY STEP, FLOORED
    Dim pthX As int32 = Math.floor((ptCk.X - dom.u0) / ((dom.U1 - dom.U0) / div))
    Dim pthY As int32 = Math.floor((ptCk.y - dom.v0) / ((dom.v1 - dom.v0) / div))
    pthX = math.min(math.Max(pthX, 0), div - 1)
    pthY = math.min(math.Max(pthY, 0), div - 1)
    Dim pthXY As New gh_path(pthX, pthY)
    ck(1) = -10

    'CHECK ALREADY ADDED NODES
    If vTree.pathExists(pthXY) Then
      For j As int32=0 To vTree.branch(pthXY).count - 1
        If ptCk.DistanceTo(vTree(pthXY, j)) < .1 Then
          ck(0) += 1
          ck(1) = nTree(pthXY, j)
          Exit For
        End If
      Next
    End If

    'IF NOT ALREADY ADDED, THEN ADD
    If  ck(0) = 0 AndAlso ck(1) < 0 Then
      ck(1) = vTree.datacount
      nTree.add(vTree.datacount, pthXY)
      vTree.add(ptCk, pthXY)
    End If

  End Sub


  Sub EdgeDirection(ByRef eCurr As Line, ByRef degList As List(Of Double))
    'FIND DIRECTION OF EDGE
    Dim deg As Double
    If eCurr.direction.x = 0 Then
      deg = (90 * (eCurr.Direction.Y / math.abs(eCurr.Direction.Y))) + 360
      deg = (360 + deg) Mod 360
    Else
      deg = ((math.atan(eCurr.Direction.Y / eCurr.Direction.x)) * 180 / math.PI)
      If eCurr.Direction.X < 0 Then deg = 180 + deg
      If eCurr.Direction.X > 0  Then deg = (360 + deg) Mod 360
    End If

    degList.add(deg)
    degList.add((deg + 180) Mod 360)
  End Sub


  Sub loopFace(ByVal eList As list(Of line), ByRef ck As list(Of Boolean), ByVal eNE As datatree(Of int32), ByVal n As int32, ByVal init As int32, ByRef fList As datatree(Of int32), ByRef f As datatree(Of point3d), ByRef efList As List(Of int32), ByRef ct As int32)
    If n <> init Then
      f.add(eList(n).pointAt(0), New gh_path(ct))
      fList.add(n, New gh_path(ct))
      efList(n) = ct
      ck(n) = False
      loopFace(eList, ck, eNE, eNE(New GH_Path(n), 0), init, fList, f, efList, ct)
    End If
  End Sub
# ---------- end hem_open_xy_networks ----------
pline = PolyLine(Vertices=hem_open_xy_networks.f, Closed=True)
flatten = FlattenTree(Tree=pline, Path="{0}")
srf = Surface(flatten)
area = Area(Geometry=srf)  # -> Area, Centroid
sort = SortList(Keys=area.Area, ValuesA=flatten)  # -> Keys, ValuesA

# ---- group: make lines to polygons
shift = ShiftList(List=sort.ValuesA, Shift=-1, Wrap=False)

# ----
graft = GraftTree(Tree=shift, IncludeEmptyLists=True, IncludeNullItems=True)
boundary = BoundarySurfaces(Edges=graft)  # -> flatten(Surfaces)
srf_2 = Surface(boundary)
Z = UnitZ(Factor=50)
extr = Extrude(Base=srf_2, Direction=Vector(0, 0, -100))
bool = ClusterInput()
move = Move(Geometry=extr, Motion=Z)  # -> Geometry, Transform
bool_2 = Boolean(bool)
python = GhPythonScript(run=bool_2, geo=move.Geometry)  # -> out, Form_InternalLines; inputs geo: list of Brep
# ---------- python: Python ----------
__author__ = "Hao"
__version__ = "2018.1.28"


import rhinoscriptsyntax as rs
import scriptcontext as sc
import Rhino
import ghpythonlib.treehelpers as ghtree
import math
import ghpythonlib.components as gh

import clr
import os
import time
clr.AddReferenceToFileAndPath("C:\\PolyFramework\\PolyFramework.dll")

import Rhino.Geometry as rg
import PolyFramework as pf

if run:
    
    sc.doc = Rhino.RhinoDoc.ActiveDoc
    rhdoc = Rhino.RhinoDoc.ActiveDoc
    
    rs.Command("_SelAll")
    rs.Command("_Delete")
    
    rs.AddLayer("temp")
    a = rs.ObjectsByLayer("temp")
    rs.DeleteObjects(a)
    
    rl = Rhino.DocObjects.ObjectAttributes()
    rl.LayerIndex = rhdoc.Layers.FindName("temp").Index
    for geoi in geo:
        rhdoc.Objects.Add(geoi,rl)
    
    rs.Command("_SelLayerNumber "+str(rhdoc.Layers.FindName("temp").Index))
    rs.Command("PFBuild _Enter _Enter _Enter")
    rs.Command("_SelLayerNumber "+str(rhdoc.Layers.FindName("_Force_Lines").Index))
    rs.Command("PFDual _Enter _Enter _Enter _Enter")
    
    Form_InternalLines = rs.ObjectsByLayer("_Form_InternalLines")
# ---------- end python ----------
form_internallines = ClusterOutput(python.Form_InternalLines)

# ==== cluster Generate_ANN_Input
bool = ClusterInput()
crv = ClusterInput()
bool_2 = Boolean(bool)
crv_2 = Curve(crv)
python = GhPythonScript(Form_InternalLines=crv_2, pleaserun=bool_2)  # -> out, linestemp, edgetemp, facetemp; inputs Form_InternalLines: list of Curve, pleaserun: Boolean
# ---------- python: Python ----------
__author__ = "Platina"
__version__ = "2019.12.15"

import rhinoscriptsyntax as rs
import scriptcontext as sc
import Rhino
import ghpythonlib.treehelpers as ghtree
import math
import ghpythonlib.components as gh

import clr
import os
import time
clr.AddReferenceToFileAndPath("C:\\PolyFramework\\PolyFramework.dll")

import Rhino.Geometry as rg
import PolyFramework as pf

if pleaserun:
    rhdoc = Rhino.RhinoDoc.ActiveDoc
    linestemp = []
    edgetemp = []
    facetemp = []
    rs.Command("_SelLayerNumber "+str(rhdoc.Layers.FindName("_Form_InternalLines").Index))
    primal = pf.PFoam()
    dual = pf.PFoam()
    containerType = pf.ContainerType
    multiData = pf.LoadData.LoadPrimalDual(True)
    guids = multiData[0]
    primal = multiData[1]
    dual = multiData[2]
    containerType = multiData[3]
    for edge in primal.Edges:
        if (edge.Dual) and (edge.Id>=0):
            if (edge.GetLength()>0) and (edge.Dual.Area>0):
                linestemp.append(edge.CreateLine())
                edgelength = edge.GetLength()
                edgetemp.append(edge.GetLength())
                facearea = edge.Dual.Area
                facetemp.append(edge.Dual.Area)
# ---------- end python ----------
curvepoint = PointOnCurve(python.linestemp, parameter=0.5)
curvepoint_2 = PointOnCurve(crv_2, parameter=0.5)
cp = ClosestPoint(Point=curvepoint_2, Cloud=curvepoint)  # -> ClosestPoint, CPIndex, Distance
item = ListItem(List=python.facetemp, Index=cp.CPIndex, Wrap=True)
end = EndPoints(Curve=crv_2)  # -> Start, End
pdecon = Deconstruct(Point=end.Start)  # -> XComponent, YComponent, ZComponent
pdecon_2 = Deconstruct(Point=end.End)  # -> XComponent, YComponent, ZComponent
merge = Merge(
    Data1=simplify(graft(pdecon.XComponent)),
    Data2=simplify(graft(pdecon.YComponent)),
    Data3=simplify(graft(pdecon_2.XComponent)),
    Data4=simplify(graft(pdecon_2.YComponent)),
    Data5=simplify(graft(item)))
merge_2 = Merge(
    Data1=simplify(graft(pdecon_2.XComponent)),
    Data2=simplify(graft(pdecon_2.YComponent)),
    Data3=simplify(graft(pdecon.XComponent)),
    Data4=simplify(graft(pdecon.YComponent)),
    Data5=simplify(graft(item)))
join = TextJoin(Text=merge_2, Join=",")  # -> flatten(Result)
join_2 = TextJoin(Text=merge, Join=",")  # -> flatten(Result)
merge_3 = Merge(Data1=join_2, Data2=join)  # -> flatten(Result)
panel = Panel(merge_3)
python_2 = FileCreator(name="C:\AIStructureGenerator\ANN\pre", ext="csv", lines=merge_3, write=bool_2)  # -> file_path; inputs lines: list, write: Boolean
# ---------- python_2: Python ----------
"""
Creates a file with a given ndame and extension.
    Inputs:
        name: Desired file name.
        ext: Desired file extension.
        lines: Text to write.
        write: Set to True to write.
"""

# Stephen P. Maher /  2015

ghenv.Component.Name = "File Creator"

import Grasshopper as gh
import os

gh_path = ghdoc.Path # Get GH file path
file = os.path.dirname(os.path.realpath(gh_path)) # Get GH file directory to save to

if "." not in ext: ext = "." + ext
else: pass

#if os.path.exists(file) == False: # Test if file already exists; if it doesn't, proceed
file = name + ext # Set file name and extension
#if os.path.exists(file) == True: # If it does exists, follow the next steps
#    file_count = len([f for f in os.walk(".").next()[2] if f[-4:] == ext]) # Find all files with the same extension
#    file = name + "_" + str(file_count) + ext # Add the number to the new file name as a differentiator

if write:
    filePath = open(file, "w") # Open the file
    for line in lines: # Iterate through lines
        filePath.write(line + "\n") # Write separate lines
    filePath.close() # Close the file
else:
    msg = "Set 'write' to True."
    ghenv.Component.AddRuntimeMessage(gh.Kernel.GH_RuntimeMessageLevel.Warning, msg)

file_path = file
# ---------- end python_2 ----------
file_path = ClusterOutput(python_2)

# ==== cluster Generate_Structural_Form
pleaserun = ClusterInput()
num = ClusterInput()
num_2 = ClusterInput()
pt = ClusterInput()
pt_2 = ClusterInput()
num_3 = ClusterInput()
F = ClusterInput()
crv = ClusterInput()
num_4 = Number(num_3)
pt_3 = Point(pt)
pt_4 = Point(pt_2)
num_5 = Number(num)
num_6 = Number(num_2)
python = GhPythonScript(file_path=F, run=pleaserun)  # -> out, a; inputs run: Boolean; disabled
# ---------- python: Python ----------
__author__ = "Platina"
__version__ = "2021.07.19"

import rhinoscriptsyntax as rs
import csv
import ghpythonlib.treehelpers as ghtree

if run:
    with open(file_path, 'r') as f:
        a = []
        reader = csv.reader(f)
        for row in reader:
            temp = float(row[0])
            a.append(temp)
    
    a = ghtree.list_to_tree(a)
# ---------- end python ----------
file = ReadFile(File=F, PerLineParse=True)
file_2 = ReadFile(File="C:\AIStructureGenerator\ANN2\results.csv", PerLineParse=True)
crv_2 = Curve(crv)
num_7 = Number(file)
split = TextSplit(Text=file_2, Separators=",")
crv_3 = ClusterInput()
multiplication = Multiplication(A=num_7, B=num_6)
num_8 = Number(split)
bool = ClusterInput()
crv_4 = Curve(crv_3)
lng = ListLength(List=crv_4)
lng_2 = ListLength(List=multiplication)
dup = DuplicateData(Data=0.5, Number=lng, Order=True)
bool_2 = Boolean(bool)
division = Division(A=lng_2, B=2)
python_2 = GhPythonScript(x=dup, y=num_8, z=bool_2)  # -> out, a; inputs x: list, y: list, z: Boolean
# ---------- python_2: Python ----------
__author__ = "Platina"
__version__ = "2021.08.16"

import rhinoscriptsyntax as rs

if z==True:
    a = y
else:
    a = x
# ---------- end python_2 ----------
boundary = BoundarySurfaces(Edges=crv_4)
subtraction = Subtraction(A=division, B=1)
crv_5 = Curve(boundary)
dom = ConstructDomain(DomainStart=0, DomainEnd=subtraction)
subset = SubList(List=multiplication, Domain=dom, Wrap=True)  # -> List, Index
explode = Explode(Curve=crv_5, Recursive=True)  # -> Segments, Vertices
num_9 = ClusterInput()
pt_5 = Point(explode.Vertices)
divide = DivideCurve(Curve=crv_2, Count=100, Kinks=False)  # -> Points, Tangents, Parameters
data = Data(subset.List)
num_10 = Number(num_9)
python_3 = GhPythonScript(
    pleaserun=pleaserun,
    constraint=divide.Points,
    marker=pt_5,
    ori=crv_4,
    ori_len=data,
    tor=num_10,
    ran=python_2.a,
    BCM=num_5,
    additional_constraint_force=pt_3,
    additional_constraint_bou=pt_4,
    perp_steps=num_4)  # -> out, bakeout, done; inputs constraint: list of Point3d, marker: list of Point3d, ori: list of Curve, ori_len: list, ran: list, additional_constraint_force: list of Point3d, additional_constraint_bou: list of Point3d, perp_steps: Int32
# ---------- python_3: Python ----------
__author__ = "Hao"
__version__ = "2018.1.28"


import rhinoscriptsyntax as rs
import scriptcontext as sc
import Rhino
import ghpythonlib.treehelpers as ghtree
import math
import ghpythonlib.components as gh

import clr
import os
import time
clr.AddReferenceToFileAndPath("C:\\PolyFramework\\PolyFramework.dll")

import Rhino.Geometry as rg
import PolyFramework as pf

done = False

if pleaserun :
    
    cir = gh.Interpolate(constraint,3,True)[0]
    
    InternalLines = []
    ExternalForces = []
    ExternalPoly = []
    
    edgelengths = []
    faceareas = []
    lines = []
    mibfs = []
    primals = []
    
    countc = 0
    
    sc.doc = Rhino.RhinoDoc.ActiveDoc
    rhdoc = Rhino.RhinoDoc.ActiveDoc
    rs.Command("_SelLayerNumber "+str(rhdoc.Layers.FindName("_Form_InternalLines").Index))
    primal = pf.PFoam()
    dual = pf.PFoam()
    containerType = pf.ContainerType
    multiData = pf.LoadData.LoadPrimalDual(True)
    guids = multiData[0]
    primal = multiData[1]
    dual = multiData[2]
    containerType = multiData[3]
    geoouttemp = rs.ObjectsByLayer('_Form_ExternalForces')
    geoouttemp = [rs.coercecurve(j) for j in geoouttemp]
    ExternalForcestemp = geoouttemp
    pt1 = gh.EndPoints(ExternalForcestemp)[0]
    pt2 = gh.EndPoints(ExternalForcestemp)[1]
    pt1.extend(pt2)
    ptall = pt1
    result = []
    for i in range(len(ptall)):
        for j in range(len(marker)):
            if rs.Distance(ptall[i],marker[j])<0.01:
                result.append(ptall[i])
                break
    pickedVertsup = []
    fixableVerts ={}
    result2 = []
    for vert in primal.Vertices:
        id = vert.Id
        location = vert.Point
        for i in range(len(result)):
            if rs.Distance(result[i],location)<0.01:
                fixableVerts[location] = vert
                pickedVertsup.append(fixableVerts[location])
                primal.SetVertexConstraints([fixableVerts[location]], cir, BCM, True)
                result2.append(location)
                break
    
    if additional_constraint_force!=None:
        for vert in primal.Vertices:
            id = vert.Id
            location = vert.Point
            for i in range(len(additional_constraint_force)):
                if rs.Distance(additional_constraint_force[i],location)<0.01:
                    fixableVerts[location] = vert
                    pickedVertsup.append(fixableVerts[location])
                    primal.SetVertexConstraints([fixableVerts[location]], rs.coercegeometry(rs.AddPoint(additional_constraint_bou[i])), BCM, True)
                    result2.append(location)
                    break
    
    stpp = []
    enpp = []
    for i in range(len(ori)):
        temp = gh.EndPoints(ori[i])
        stpp.append(temp[0])
        enpp.append(temp[1])
    for edge in primal.Edges:
        for i in range(len(ori)):
            if (rs.Distance(stpp[i],edge.Vertices[0].Point)<0.01) and (rs.Distance(enpp[i],edge.Vertices[1].Point)<0.01) or (rs.Distance(stpp[i],edge.Vertices[1].Point)<0.01) and (rs.Distance(enpp[i],edge.Vertices[1].Point)<0.01):
                   edge.MinLength = (0.5+ran[i]*1.0)*ori_len[i]*(1.0-tor)
                   edge.MaxLength = (0.5+ran[i]*1.0)*ori_len[i]*(1.0+tor)
    
    #primal.PerpSoft(maxSteps = perp_steps)
    #primal.Perp(maxSteps = perp_steps)
    #primal.ParaPerp(maxSteps = perp_steps)
    #primal.PerpSoftParaAsync(perp_steps,0.01)
    primal.PerpSoftPara(perp_steps,0.01)
    
    rs.Command("_SelAll")
    rs.Command("_Delete")
    bakeout = pf.PFoam.SaveAsEdges(primal)
    done = True
# ---------- end python_3 ----------
done = ClusterOutput(python_3.done)

# ==== cluster Generate_ForceDragonflyWingFc2_1to7SmoothAirplaneWing
pt = ClusterInput()
pt_2 = ClusterInput()
txt = ClusterInput()
pt_3 = ClusterInput()
bool = ClusterInput()
num = ClusterInput()
pt_4 = Point(pt)
pt_5 = Point(pt_2)
txt_2 = Text(txt)
pt_6 = Point(pt_3)
bool_2 = Boolean(bool)
num_2 = Number(num)
generate_force_geometry = GhPythonScript(pt1=pt_4, file_path=txt_2, run=bool_2)  # -> out, file_path_blacklines, file_path_redske, file_path_img, file_path_bou, file_path_internal_bou; inputs pt1: Point3d, run: Boolean
# ---------- generate_force_geometry: Python ----------
__author__ = "Platina"
__version__ = "2021.07.19"

import rhinoscriptsyntax as rs
import os

if run:
    
    os.system("cd C:\\AIStructureGenerator && C: && python get_skeleton_fc2.py")
    
    file_path_blacklines = 'C:\\AIStructureGenerator\\results\\result_mp_blacklines.csv'
    
    file_path_redske = 'C:\\AIStructureGenerator\\results\\result_mp_redske.csv'
    
    file_path_img = 'C:\\AIStructureGenerator\\results\\result_mp.jpg'
    
    file_path_bou = 'C:\\AIStructureGenerator\\results\\result_bou.csv'
    
    file_path_internal_bou = 'C:\\AIStructureGenerator\\results\\result_mp_internal_bou.csv'
# ---------- end generate_force_geometry ----------
dist = Distance(PointA=pt_6, PointB=pt_4)
pdecon = Deconstruct(Point=pt_5)  # -> XComponent, YComponent, ZComponent
pdecon_2 = Deconstruct(Point=pt_4)  # -> XComponent, YComponent, ZComponent
division = Division(A=dist, B=1024)
subtraction = Subtraction(A=pdecon.XComponent, B=pdecon_2.XComponent)
python = GhPythonScript(filename=generate_force_geometry.file_path_img, tor_r=Slider(100, range=0..255))  # -> out, b
# ---------- python: Python ----------
import rhinoscriptsyntax as rs
import System.Drawing as SD
import time
import ghpythonlib.treehelpers as ghtree

#filter = "BMP (*.bmp)|*.bmp|PNG (*.png)|*.png|JPG (*.jpg)|*.jpg|All (*.*)|*.*||"
filter = "JPG (*.jpg)|*.jpg"

img = SD.Bitmap(filename)
# make some red stripes on the image
w = img.Width
h = img.Height
#color = SD.Color.Red;
b = []
rs.EnableRedraw(False)
for x in range(w):
    for y in range(h):
        color = img.GetPixel(x, y)
        if (color.R>255-tor_r) and (color.G<tor_r) and (color.B<tor_r):
            b.append([x+0.5,img.Height-y-0.5,color.G])
rs.EnableRedraw(True)

b = ghtree.list_to_tree(b)

img.Dispose()
# ---------- end python ----------
python_2 = GhPythonScript(filename=generate_force_geometry.file_path_img, tor_g=Slider(0.75, range=0..1), tor_b=Slider(180, range=0..255))  # -> out, b
# ---------- python_2: Python ----------
import rhinoscriptsyntax as rs
import System.Drawing as SD
import time
import ghpythonlib.treehelpers as ghtree

#filter = "BMP (*.bmp)|*.bmp|PNG (*.png)|*.png|JPG (*.jpg)|*.jpg|All (*.*)|*.*||"
filter = "JPG (*.jpg)|*.jpg"

img = SD.Bitmap(filename)
# make some red stripes on the image
w = img.Width
h = img.Height
#color = SD.Color.Red;
b = []
rs.EnableRedraw(False)
for x in range(w):
    for y in range(h):
        color = img.GetPixel(x, y)
        if (color.B>255-tor_b) and (color.G<255*tor_g) and (color.R>240):
            b.append([x+0.5,img.Height-y-0.5,color.G])
rs.EnableRedraw(True)

b = ghtree.list_to_tree(b)

img.Dispose()
# ---------- end python_2 ----------
file = ReadFile(File=generate_force_geometry.file_path_bou, PerLineParse=True)
file_2 = ReadFile(File=generate_force_geometry.file_path_internal_bou, PerLineParse=True)
file_3 = ReadFile(File=generate_force_geometry.file_path_redske, PerLineParse=True)
file_4 = ReadFile(File=generate_force_geometry.file_path_blacklines, PerLineParse=True)
division_2 = Division(A=subtraction, B=24)
split = TextSplit(Text=file, Separators=",")
split_2 = TextSplit(Text=file_2, Separators=",")
item = ListItem(List=python.b, Index=0, Wrap=True)  # -> Item, Item1, Item2
split_3 = TextSplit(Text=file_3, Separators=",")  # -> simplify(Result)
split_4 = TextSplit(Text=file_4, Separators=",")  # -> simplify(Result)
item_2 = ListItem(List=python_2.b, Index=0, Wrap=True)  # -> Item, Item1, Item2
neg = Negative(Value=division_2)
pt_7 = ConstructPoint(XCoordinate=0, YCoordinate=256, ZCoordinate=0)
item_3 = ListItem(List=split, Index=0, Wrap=True)  # -> Item, Item1
item_4 = ListItem(List=split_2, Index=0, Wrap=True)  # -> Item, Item1
pt_8 = ConstructPoint(XCoordinate=item.Item, YCoordinate=item.Item1, ZCoordinate=0)  # -> flatten(Point)
split_5 = TextSplit(Text=split_3, Separators=" ")  # -> simplify(Result)
pt_9 = ConstructPoint(XCoordinate=item_2.Item, YCoordinate=item_2.Item1, ZCoordinate=0)  # -> flatten(Point)
split_6 = TextSplit(Text=split_4, Separators=" ")  # -> simplify(Result)
flatten = FlattenTree(Tree=item_2.Item2, Path="{0}")
X = UnitX(Factor=neg)
xz = XZPlane(Origin=pt_7)
pt_10 = ConstructPoint(XCoordinate=item_3.Item, YCoordinate=item_3.Item1, ZCoordinate=0)
pt_11 = ConstructPoint(XCoordinate=item_4.Item, YCoordinate=item_4.Item1, ZCoordinate=0)
duppt = RemoveDuplicatePts(Points=pt_9, Tolerance="6")
split_7 = TextSplit(Text=split_5, Separators=" .")  # -> simplify(Result)
split_8 = TextSplit(Text=split_6, Separators=" .")  # -> simplify(Result)
division_3 = Division(A="6", B=2)
mirror = Mirror(Geometry=pt_10, Plane=xz)  # -> flatten(Geometry), Transform
mirror_2 = Mirror(Geometry=pt_11, Plane=xz)  # -> flatten(Geometry), Transform
cir = Circle(Plane=duppt, Radius=division_3)
trim = TrimTree(Tree=split_7, Depth=1)
trim_2 = TrimTree(Tree=split_8, Depth=1)
pline = PolyLine(Vertices=mirror.Geometry, Closed=False)
incurves = PointInCurves(Point=pt_9, Curves=cir)  # -> Relationship, Index, Point
pline_2 = PolyLine(Vertices=mirror_2.Geometry, Closed=False)
split_9 = TextSplit(Text=trim, Separators="[")  # -> simplify(Result)
split_10 = TextSplit(Text=trim_2, Separators="[")  # -> simplify(Result)
python_3 = GhPythonScript(x=incurves.Index, y=pt_9, z=flatten)  # -> out, a, b; inputs x: list, y: list, z: list
# ---------- python_3: Python ----------
__author__ = "Platina"
__version__ = "2021.11.21"

import rhinoscriptsyntax as rs
import ghpythonlib.treehelpers as ghtree

a = [[] for i in range(max(x)+1)]
b = [[] for i in range(max(x)+1)]

for i in range(len(x)):
    a[x[i]].append(y[i])
    b[x[i]].append(z[i])

a = ghtree.list_to_tree(a)
b = ghtree.list_to_tree(b)
# ---------- end python_3 ----------

avr = Average(Input=python_3.b)  # -> flatten(ArithmeticMean)
avr_2 = Average(Input=python_3.a)  # -> flatten(ArithmeticMean)

trim_3 = TrimTree(Tree=split_9, Depth=1)
trim_4 = TrimTree(Tree=split_10, Depth=1)
division_4 = Division(A=avr, B="255")
split_11 = TextSplit(Text=trim_3, Separators="]")  # -> simplify(Result)
split_12 = TextSplit(Text=trim_4, Separators="]")  # -> simplify(Result)
multiplication = Multiplication(A=division_4, B="1500")
trim_5 = TrimTree(Tree=split_11, Depth=1)
trim_6 = TrimTree(Tree=split_12, Depth=1)
multiplication_2 = Multiplication(A=multiplication, B=Slider(0.29, range=0..1))
division_5 = Division(A=multiplication_2, B="10000")
multiplication_3 = Multiplication(A=division_5, B="1024")
max = Maximum(A=multiplication_3, B=0.1)
cir_2 = Circle(Plane=avr_2, Radius=max)
num_3 = Number(trim_6)
num_4 = Number(trim_5)
null = NullItem(Item=num_4)  # -> NullFlags, InvalidFlags, Description
null_2 = NullItem(Item=num_3)  # -> NullFlags, InvalidFlags, Description
not = GateNot(A=null.NullFlags)
not_2 = GateNot(A=null_2.NullFlags)
cull = CullPattern(List=num_4, CullPattern=not)
cull_2 = CullPattern(List=num_3, CullPattern=not_2)
item_5 = ListItem(List=cull_2, Index=0, Wrap=True)  # -> Item, Item1
item_6 = ListItem(List=cull, Index=0, Wrap=True)  # -> Item, Item1
pt_12 = ConstructPoint(XCoordinate=0, YCoordinate=256, ZCoordinate=0)
pt_13 = ConstructPoint(XCoordinate=0, YCoordinate=256, ZCoordinate=0)
pt_14 = ConstructPoint(XCoordinate=item_6.Item1, YCoordinate=item_6.Item, ZCoordinate=0)

pt_15 = ConstructPoint(XCoordinate=512, YCoordinate=256, ZCoordinate=0)  # disabled
xz_2 = XZPlane(Origin=pt_15)  # disabled
number_slider = Slider(5, range=0..10)  # disabled
mirror_3 = Mirror(Geometry=pt_14, Plane=xz_2)  # -> Geometry, Transform; disabled
trim_7 = TrimTree(Tree=mirror_3.Geometry, Depth=1)  # disabled
cp = ClosestPoint(Point=mirror_3.Geometry, Cloud=avr_2)  # -> ClosestPoint, CPIndex, Distance; disabled
pline_3 = PolyLine(Vertices=trim_7, Closed=False)  # disabled
end = EndPoints(Curve=pline_3)  # -> Start, End; disabled
smaller = SmallerThan(FirstNumber=cp.Distance, SecondNumber=number_slider)  # -> SmallerThan, OrEqualTo; disabled
flatten_2 = FlattenTree(Tree=pline_3, Path="{0}")  # disabled
end_2 = EndPoints(Curve=pline_3)  # -> Start, End; disabled
ln = Line(StartPoint=end.Start, EndPoint=end.End)  # disabled
cull_3 = CullPattern(List=mirror_3.Geometry, CullPattern=smaller.SmallerThan)  # disabled
cull_4 = CullPattern(List=cp.CPIndex, CullPattern=smaller.SmallerThan)  # disabled
crv_cp = CurveClosestPoint(Point=end_2.Start, Curve=flatten_2)  # -> Point, Parameter, Distance; disabled
crv_cp_2 = CurveClosestPoint(Point=end_2.End, Curve=flatten_2)  # -> Point, Parameter, Distance; disabled
trim_8 = TrimTree(Tree=cull_3, Depth=1)  # disabled
trim_9 = TrimTree(Tree=cull_4, Depth=1)  # disabled
item_7 = ListItem(List=trim_9, Index=0, Wrap=True)  # -> Item1, Item; disabled
merge = Merge(Data1=item_7.Item, Data2=trim_9, Data3=item_7.Item1)  # disabled
merge_2 = Merge(Data1=end.Start, Data2=trim_8, Data3=end.End)  # disabled
smaller_2 = SmallerThan(FirstNumber=crv_cp.Distance, SecondNumber=3)  # -> SmallerThan, OrEqualTo; disabled
smaller_3 = SmallerThan(FirstNumber=crv_cp_2.Distance, SecondNumber=3)  # -> SmallerThan, OrEqualTo; disabled
null_3 = NullItem(Item=merge)  # -> NullFlags, InvalidFlags, Description; disabled
or = GateOr(A=smaller_2.SmallerThan, B=smaller_3.SmallerThan)  # disabled
not_3 = GateNot(A=null_3.NullFlags)  # disabled
not_4 = GateNot(A=or)  # disabled
cull_5 = CullPattern(List=merge_2, CullPattern=not_3)  # disabled
flatten_3 = FlattenTree(Tree=cull_5, Path="{0}")  # disabled
lng = ListLength(List=cull_5)  # disabled
graft = GraftTree(Tree=flatten_3, IncludeEmptyLists=True, IncludeNullItems=True)  # -> simplify(Tree); disabled
crv_cp_3 = CurveClosestPoint(Point=graft, Curve=flatten_2)  # -> Point, Parameter, Distance; disabled
larger = LargerThan(FirstNumber=lng, SecondNumber=2)  # -> LargerThan, flatten(OrEqualTo); disabled
cull_6 = CullPattern(List=merge, CullPattern=not_3)  # disabled
and = GateAnd(A=not_4, B=larger.OrEqualTo)  # disabled
item_8 = ListItem(List=max, Index=cull_6, Wrap=True)  # disabled
crv_cp_4 = CurveClosestPoint(Point=cull_5, Curve=pline_3)  # -> Point, Parameter, Distance; disabled
dup = DuplicateData(Data=and, Number=lng, Order=True)  # -> simplify(Data); disabled
unflatten = UnflattenTree(Tree=dup, Guide=crv_cp_3.Distance)  # disabled
cir_3 = Circle(Plane=cull_5, Radius=item_8)  # disabled
eval = EvaluateCurve(Curve=pline_3, Parameter=crv_cp_4.Parameter)  # -> Point, Tangent, Angle; disabled
cull_7 = CullPattern(List=crv_cp_3.Distance, CullPattern=unflatten)  # disabled
rotate = Rotate(Geometry=eval.Tangent, Angle=1.570796327, Plane=PlaneXY(0, 0, 0))  # -> Geometry, Transform; disabled
sort = SortList(Keys=cull_7)  # -> Keys, ValuesA; disabled
unit = UnitVector(Vector=rotate.Geometry)  # disabled
item_9 = ListItem(List=sort.Keys, Index=0, Wrap=True)  # -> flatten(Item); disabled
division_6 = Division(A=item_9, B=2)  # disabled
multiplication_4 = Multiplication(A=division_6, B=1)  # disabled
unflatten_2 = UnflattenTree(Tree=multiplication_4, Guide=item_8)  # disabled
min = Minimum(A=unflatten_2, B=item_8)  # disabled
multiplication_5 = Multiplication(A=unit, B=min)  # disabled
neg_2 = Negative(Value=multiplication_5)  # disabled
move = Move(Geometry=cull_5, Motion=multiplication_5)  # -> Geometry, Transform; disabled
move_2 = Move(Geometry=cull_5, Motion=neg_2)  # -> Geometry, Transform; disabled
item_10 = ListItem(List=move_2.Geometry, Index=0, Wrap=True)  # -> Item1, Item; disabled
item_11 = ListItem(List=move.Geometry, Index=0, Wrap=True)  # -> Item1, Item; disabled
ln_2 = Line(StartPoint=item_11.Item1, EndPoint=item_10.Item1)  # disabled
ln_3 = Line(StartPoint=item_11.Item, EndPoint=item_10.Item)  # disabled
pline_4 = PolyLine(Vertices=move.Geometry, Closed=False)  # disabled
pline_5 = PolyLine(Vertices=move_2.Geometry, Closed=False)  # disabled
cir_4 = Circle(Plane=cull_5, Radius=min)  # disabled

pt_16 = ConstructPoint(XCoordinate=item_5.Item1, YCoordinate=item_5.Item, ZCoordinate=0)
xz_3 = XZPlane(Origin=pt_12)
xz_4 = XZPlane(Origin=pt_13)
mirror_4 = Mirror(Geometry=pt_14, Plane=xz_3)  # -> Geometry, Transform
mirror_5 = Mirror(Geometry=pt_16, Plane=xz_4)  # -> Geometry, Transform
trim_10 = TrimTree(Tree=mirror_4.Geometry, Depth=1)
pline_6 = PolyLine(Vertices=trim_10, Closed=False)  # -> flatten(Polyline)
trim_11 = TrimTree(Tree=mirror_5.Geometry, Depth=1)
end_3 = EndPoints(Curve=pline_6)  # -> Start, End
pline_7 = PolyLine(Vertices=trim_11, Closed=False)  # -> flatten(Polyline)
end_4 = EndPoints(Curve=pline_7)  # -> Start, End
graft_2 = GraftTree(Tree=end_3.End, IncludeEmptyLists=True, IncludeNullItems=True)
graft_3 = GraftTree(Tree=end_4.End, IncludeEmptyLists=True, IncludeNullItems=True)
smoothpline = SmoothPolyline(Polyline=pline_7, Strength=1, Times=Slider(1000, range=0..1000))
smoothpline_2 = SmoothPolyline(Polyline=pline_7, Strength=1, Times=Slider(100, range=0..1000))
divlength = DivideLength(Curve=pline_6, Length=50)  # -> Points, Tangents, Parameters
divlength_2 = DivideLength(Curve=pline_7, Length=50)  # -> Points, Tangents, Parameters
len = Length(Curve=smoothpline)
merge_3 = Merge(Data1=divlength.Points, Data2=graft_2)
merge_4 = Merge(Data1=divlength_2.Points, Data2=graft_3)
larger_2 = LargerThan(FirstNumber=len, SecondNumber=8)  # -> LargerThan, OrEqualTo
pline_8 = PolyLine(Vertices=merge_3, Closed=False)  # -> flatten(Polyline)
pline_9 = PolyLine(Vertices=merge_4, Closed=False)  # -> flatten(Polyline)
cull_8 = CullPattern(List=smoothpline, CullPattern=larger_2.LargerThan)
explode = Explode(Curve=pline_8, Recursive=True)  # -> flatten(Segments), Vertices
explode_2 = Explode(Curve=pline_9, Recursive=True)  # -> flatten(Segments), Vertices
len_2 = Length(Curve=explode.Segments)
len_3 = Length(Curve=explode_2.Segments)
larger_3 = LargerThan(FirstNumber=len_2, SecondNumber=0.01)  # -> LargerThan, OrEqualTo
larger_4 = LargerThan(FirstNumber=len_3, SecondNumber=0.01)  # -> LargerThan, OrEqualTo
cull_9 = CullPattern(List=explode.Segments, CullPattern=larger_3.LargerThan)
graft_4 = GraftTree(Tree=avr_2, IncludeEmptyLists=True, IncludeNullItems=True)
cull_10 = CullPattern(List=explode_2.Segments, CullPattern=larger_4.LargerThan)
dupln = RemoveDuplicateLines(Lines=cull_9, Tolerance=0.01)
crv_cp_5 = CurveClosestPoint(Point=graft_4, Curve=dupln)  # -> Point, Parameter, Distance
dupln_2 = RemoveDuplicateLines(Lines=cull_10, Tolerance=0.01)
crv = Curve(dupln_2)
remove_1 = Remove1(C=crv)
curvepoint = PointOnCurve(remove_1, parameter=0.5)
scale = Scale(Geometry=remove_1, Center=curvepoint, Factor=2)  # -> Geometry, Transform
crv_2 = Curve(scale.Geometry)
end_5 = EndPoints(Curve=crv_2)  # -> Start, End
merge_5 = Merge(Data1=end_5.Start, Data2=end_5.End)
vec2pt = Vector2Pt(PointA=end_5.Start, PointB=end_5.End, Unitize=False)  # -> Vector, Length
remove_1_2 = Remove1(C=remove_1)
duppt_2 = RemoveDuplicatePts(Points=merge_5, Tolerance=0.01)
remove_1_3 = Remove1(C=remove_1_2)
remove_1_4 = Remove1(C=remove_1_3)
remove_1_5 = Remove1(C=remove_1_4)
remove_1_6 = Remove1(C=remove_1_5)
remove_1_7 = Remove1(C=remove_1_6)
remove_1_8 = Remove1(C=remove_1_7)
end_6 = EndPoints(Curve=remove_1_8)  # -> Start, End
merge_6 = Merge(Data1=end_6.Start, Data2=end_6.End)
duppt_3 = RemoveDuplicatePts(Points=merge_6, Tolerance=0.01)
del = DelaunayMesh(Points=duppt_3, Plane=PlaneXY(0, 0, 0))
wbedges = WeaverbirdsMeshEdges(MeshOrPolylines=del)
dupln_3 = RemoveDuplicateLines(Lines=wbedges, Tolerance=0.01)
len_4 = Length(Curve=dupln_3)
smaller_4 = SmallerThan(FirstNumber=len_4, SecondNumber=60)  # -> SmallerThan, OrEqualTo
curvepoint_2 = PointOnCurve(dupln_3, parameter=0.5)
cp_2 = ClosestPoint(Point=curvepoint_2, Cloud=duppt_3)  # -> ClosestPoint, CPIndex, Distance
smaller_5 = SmallerThan(FirstNumber=cp_2.Distance, SecondNumber=30)  # -> SmallerThan, OrEqualTo
and_2 = GateAnd(A=smaller_5.SmallerThan, B=smaller_4.SmallerThan)
cull_11 = CullPattern(List=dupln_3, CullPattern=and_2)
merge_7 = Merge(Data1=cull_11, Data2=remove_1_8)  # -> flatten(Result)
dupln_4 = RemoveDuplicateLines(Lines=merge_7, Tolerance=0.01)
wbweave = WeaverbirdsMeshFromLinesWeaveBack(Lines=dupln_4, MaximumValence=1000)
explode_3 = MeshExplode(Mesh=wbweave, Interpolate=False)
end_7 = EndPoints(Curve=dupln_4)  # -> Start, End
wbedges_2 = WeaverbirdsMeshEdges(MeshOrPolylines=explode_3)
merge_8 = Merge(Data1=end_7.Start, Data2=end_7.End)
dupln_5 = RemoveDuplicateLines(Lines=wbedges_2, Tolerance=0.01)
boundary = BoundarySurfaces(Edges=dupln_5)
debrep = DeconstructBrep(Brep=boundary)  # -> Faces, Edges, Vertices
pline_10 = PolyLine(Vertices=debrep.Vertices, Closed=True)
boundary_2 = BoundarySurfaces(Edges=pline_10)  # -> flatten(Surfaces)
duppt_4 = RemoveDuplicatePts(Points=merge_8, Tolerance=0.01)
del_2 = DelaunayMesh(Points=duppt_4, Plane=PlaneXY(0, 0, 0))
wbnaked = WeaverbirdsNakedBoundary(MeshClosedPolylines=del_2)
merge_9 = Merge(Data1=flatten(wbnaked), Data2=flatten(boundary_2))
item_12 = ListItem(List=merge_9, Index=1, Wrap=True)
area = Area(Geometry=item_12)  # -> Area, Centroid
sort_2 = SortList(Keys=area.Area, ValuesA=item_12)  # -> Keys, ValuesA
item_13 = ListItem(List=sort_2.ValuesA, Index=-1, Wrap=True)
crv_3 = Curve(item_13)
divlength_3 = DivideLength(Curve=item_13, Length=10)  # -> Points, Tangents, Parameters
lng_2 = ListLength(List=divlength_3.Points)
dup_2 = DuplicateData(Data=divlength_3.Points, Number=2, Order=True)
subtraction_2 = Subtraction(A=lng_2, B=1)
dom = ConstructDomain(DomainStart=0, DomainEnd=subtraction_2)
python_4 = GhPythonScript(x=dup_2)  # -> out, pd; inputs x: list of Point3d
# ---------- python_4: Python ----------
__author__ = "Platina"
__version__ = "2021.08.19"

import rhinoscriptsyntax as rs

n = int(len(x)/2)
pd = [True for i in range(len(x))]
for i in range(n-1):
    if pd[i]==True:
        for j in range(i+5,i+50):
            if pd[j]==True:
                if rs.Distance(x[i],x[j])<20:
                    print(i,j)
                    for k in range(i+1,j):
                        pd[k] = False
# ---------- end python_4 ----------
subset = SubList(List=python_4.pd, Domain=dom, Wrap=True)  # -> List, Index
cull_12 = CullPattern(List=divlength_3.Points, CullPattern=subset.List)
intcrv = Interpolate(Vertices=cull_12, Degree=3, Periodic=True, KnotStyle=1)  # -> Curve, Length, Domain
area_2 = Area(Geometry=intcrv.Curve)  # -> Area, Centroid
cir_5 = Circle(Plane=area_2.Centroid, Radius=1)
flip = FlipCurve(Curve=cir_5)  # -> Curve, Flag
flip_2 = FlipCurve(Curve=intcrv.Curve, Guide=flip.Curve)  # -> Curve, Flag
divide = DivideCurve(Curve=intcrv.Curve, Count=15, Kinks=False)  # -> Points, Tangents, Parameters
srf = Surface(flip_2.Curve)
divide_2 = DivideCurve(Curve=srf, Count=1000, Kinks=False)  # -> Points, Tangents, Parameters
intcrv_2 = Interpolate(Vertices=divide.Points, Degree=3, Periodic=True, KnotStyle=1)  # -> Curve, Length, Domain
flip_3 = FlipCurve(Curve=intcrv_2.Curve)  # -> Curve, Flag
offset = OffsetCurve(Curve=intcrv_2.Curve, Distance=10, Plane=PlaneXY(0, 0, 0), Corners=1)
offset_2 = OffsetCurve(Curve=intcrv_2.Curve, Distance=-10, Plane=PlaneXY(0, 0, 0), Corners=1)
area_3 = Area(Geometry=offset_2)  # -> Area, Centroid
area_4 = Area(Geometry=offset)  # -> Area, Centroid
merge_10 = Merge(Data1=intcrv_2.Curve, Data2=flip_3.Curve)
crv_4 = Curve(flip_2.Curve)
larger_5 = LargerThan(FirstNumber=area_4.Area, SecondNumber=area_3.Area)  # -> LargerThan, OrEqualTo
item_14 = ListItem(List=merge_10, Index=larger_5.LargerThan, Wrap=True)
crv_cp_6 = CurveClosestPoint(Point=divide_2.Points, Curve=item_14)  # -> Point, Parameter, Distance
eval_2 = EvaluateCurve(Curve=item_14, Parameter=crv_cp_6.Parameter)  # -> Point, Tangent, Angle
rotate_2 = Rotate(Geometry=eval_2.Tangent, Angle=-1.570796327, Plane=PlaneXY(0, 0, 0))  # -> Geometry, Transform
multiplication_6 = Multiplication(A=rotate_2.Geometry, B=300)
move_3 = Move(Geometry=divide_2.Points, Motion=multiplication_6)  # -> Geometry, Transform
ln_4 = Line(StartPoint=divide_2.Points, EndPoint=move_3.Geometry)
python_5 = GhPythonScript(a=ln_4, b=crv_2, crv=crv_4)  # -> out, c; inputs a: list of Curve, b: list of Curve, crv: Curve
# ---------- python_5: Python ----------
__author__ = "Platina"
__version__ = "2021.08.19"

import rhinoscriptsyntax as rs
import ghpythonlib.components as gh
import math

c = []
for i in range(len(a)):
    dis = []
    cur = []
    spt = rs.CurveStartPoint(a[i])
    ept = rs.CurveEndPoint(a[i])
    for j in range(len(b)):
        pt = rs.CurveCurveIntersection(a[i],b[j])
        if pt!=None:
            pt = pt[0][1]
            dis.append(rs.Distance(spt,pt))
            #dis.append(gh.CurveClosestPoint(pt,crv)[2])
            cur.append(b[j])
    mind = 99999
    pp = None
    v1 = gh.Vector2Pt(spt,ept,True)[0]
    for j in range(len(dis)):
        if dis[j]>20:
            if dis[j]<mind:
                v2 = gh.Vector2Pt(rs.CurveStartPoint(cur[j]),rs.CurveEndPoint(cur[j]),True)[0]
                if (gh.Angle(v1,v2)[0]>45/180*math.pi) and (gh.Angle(v1,v2)[0]<135/180*math.pi):
                    mind = dis[j]
                    pp = rs.CurveCurveIntersection(a[i],cur[j])[0][1]
    c.append(pp)
# ---------- end python_5 ----------
ln_5 = Line(StartPoint=divide_2.Points, EndPoint=python_5.c)
ccx = CurveCurve(CurveA=ln_5, CurveB=crv_4)  # -> Points, ParamsA, ParamsB
lng_3 = ListLength(List=ccx.Points)
equals = Equality(FirstNumber=lng_3, SecondNumber=1)  # -> flatten(Equality), Inequality
cull_13 = CullPattern(List=ln_5, CullPattern=equals.Equality)
vec2pt_2 = Vector2Pt(PointA=divide_2.Points, PointB=python_5.c, Unitize=False)  # -> Vector, Length
graft_5 = GraftTree(Tree=ln_5, IncludeEmptyLists=True, IncludeNullItems=True)
lng_4 = ListLength(List=dupln)
number_slider_2 = Slider(45, range=0..100)
graft_6 = GraftTree(Tree=vec2pt_2.Vector, IncludeEmptyLists=True, IncludeNullItems=True)
crvprox = CurveProximity(CurveA=graft_5, CurveB=crv_2)  # -> PointA, PointB, Distance
angle = Angle(VectorA=graft_6, VectorB=vec2pt.Vector)  # -> simplify(Angle), Reflex
series = Series(Start=0, Step=1, Count=lng_4)
sort_3 = SortList(Keys=crv_cp_5.Distance, ValuesA=series, ValuesB=crv_cp_5.Point)  # -> Keys, ValuesA, ValuesB
subtraction_3 = Subtraction(A=180, B=number_slider_2)
item_15 = ListItem(List=sort_3.ValuesA, Index=0, Wrap=True)  # -> flatten(Item)
item_16 = ListItem(List=sort_3.ValuesB, Index=0, Wrap=True)  # -> flatten(Item)
smaller_6 = SmallerThan(FirstNumber=crvprox.Distance, SecondNumber=Slider(3, range=0..10))  # -> SmallerThan, OrEqualTo
rad = Radians(Degrees=subtraction_3)
larger_6 = LargerThan(FirstNumber=angle.Angle, SecondNumber=rad)  # -> LargerThan, OrEqualTo
item_17 = ListItem(List=dupln, Index=item_15, Wrap=True)
rad_2 = Radians(Degrees=number_slider_2)
smaller_7 = SmallerThan(FirstNumber=angle.Angle, SecondNumber=rad_2)  # -> SmallerThan, OrEqualTo
or_2 = GateOr(A=smaller_7.SmallerThan, B=larger_6.LargerThan)
crv_cp_7 = CurveClosestPoint(Point=item_16, Curve=item_17)  # -> Point, Parameter, Distance
and_3 = GateAnd(A=or_2, B=smaller_6.SmallerThan)
eval_3 = EvaluateCurve(Curve=item_17, Parameter=crv_cp_7.Parameter)  # -> Point, Tangent, Angle
ma = MassAddition(Input=and_3)  # -> flatten(Result), PartialResults
rotate_3 = Rotate(Geometry=eval_3.Tangent, Angle=1.570796327, Plane=PlaneXY(0, 0, 0))  # -> Geometry, Transform
larger_7 = LargerThan(FirstNumber=ma.Result, SecondNumber=0)  # -> LargerThan, OrEqualTo
unit_2 = UnitVector(Vector=rotate_3.Geometry)
cull_14 = CullPattern(List=ln_5, CullPattern=larger_7.LargerThan)
multiplication_7 = Multiplication(A=unit_2, B=100)
multiplication_8 = Multiplication(A=unit_2, B=-200)
end_8 = EndPoints(Curve=cull_14)  # -> Start, End
move_4 = Move(Geometry=avr_2, Motion=multiplication_7)  # -> Geometry, Transform
python_6 = GhPythonScript(x=cull_14)  # -> out, pd; inputs x: list of Curve
# ---------- python_6: Python ----------
__author__ = "Platina"
__version__ = "2021.08.19"

import rhinoscriptsyntax as rs
import ghpythonlib.components as gh

pd = [True for i in range(len(x))]

for i in range(1,len(x)):
    for j in range(max(0,i-40),i):
        if pd[j]==True:
            d = gh.CurveProximity(x[i],x[j])[2]
            if (d<gh.Length(x[i])*0.15) or (d<gh.Length(x[j])*0.15) or (d<5):
                pd[i] = False
                break
# ---------- end python_6 ----------
move_5 = Move(Geometry=move_4.Geometry, Motion=multiplication_8)  # -> Geometry, Transform
cull_15 = CullPattern(List=cull_14, CullPattern=python_6.pd)
ln_6 = Line(StartPoint=move_4.Geometry, EndPoint=move_5.Geometry)
end_9 = EndPoints(Curve=cull_15)  # -> Start, End
pt_17 = Point(end_9.End)
crv_cp_8 = CurveClosestPoint(Point=pt_17, Curve=srf)  # -> Point, Parameter, Distance
cp_3 = ClosestPoint(Point=pt_17, Cloud=pt_8)  # -> ClosestPoint, CPIndex, Distance
larger_8 = LargerThan(FirstNumber=crv_cp_8.Distance, SecondNumber=Slider(40, range=0..100))  # -> LargerThan, OrEqualTo
smaller_8 = SmallerThan(FirstNumber=cp_3.Distance, SecondNumber=5)  # -> SmallerThan, OrEqualTo
cull_16 = CullPattern(List=pt_17, CullPattern=larger_8.LargerThan)
graft_7 = GraftTree(Tree=ln_6, IncludeEmptyLists=True, IncludeNullItems=True)
cull_17 = CullPattern(List=pt_17, CullPattern=smaller_8.SmallerThan)
lng_5 = ListLength(List=cull_16)
pline_11 = PolyLine(Vertices=cull_17, Closed=True)
dup_3 = DuplicateData(Data=cull_16, Number=2, Order=True)
subtraction_4 = Subtraction(A=lng_5, B=1)
clx = CurveLine(Curve=cull_8, Line=graft_7)  # -> Points, Params, Count
dom_2 = ConstructDomain(DomainStart=0, DomainEnd=subtraction_4)
python_7 = GhPythonScript(x=dup_3)  # -> out, pd; inputs x: list of Point3d
# ---------- python_7: Python ----------
__author__ = "Platina"
__version__ = "2021.08.19"

import rhinoscriptsyntax as rs

n = int(len(x)/2)
pd = [True for i in range(len(x))]
for i in range(n-1):
    if pd[i]==True:
        for j in range(i+5,i+50):
            if pd[j]==True:
                if rs.Distance(x[i],x[j])<45:
                    print(i,j)
                    for k in range(i+1,j):
                        pd[k] = False
# ---------- end python_7 ----------
trim_12 = TrimTree(Tree=clx.Points, Depth=1)
smoothpline_3 = SmoothPolyline(Polyline=pline_11, Strength=1, Times=3)
pt_18 = Point(end_9.Start)
python_8 = GhPythonScript(x=trim_12, y=avr_2, z=ln_6)  # -> out, a; inputs x: tree of Point3d, y: list of Point3d, z: list of Curve
# ---------- python_8: Python ----------
__author__ = "Platina"
__version__ = "2021.12.09"

import rhinoscriptsyntax as rs
import ghpythonlib.treehelpers as ghtree

x = ghtree.tree_to_list(x)

a = []
for i in range(len(x)):
    temp = []
    spt = rs.CurveStartPoint(z[i])
    ept = rs.CurveEndPoint(z[i])
    spp = None
    epp = None
    sppdis = 9999
    eppdis = 9999
    for j in range(len(x[i])):
        d = rs.Distance(x[i][j],y[i])
        if rs.Distance(x[i][j],spt)>rs.Distance(x[i][j],ept):
            if d<eppdis:
                eppdis = d
                epp = x[i][j]
        if rs.Distance(x[i][j],spt)<rs.Distance(x[i][j],ept):
            if d<sppdis:
                sppdis = d
                spp = x[i][j]
    if epp!=None:
        temp.append(epp)
    if spp!=None:
        temp.append(spp)
    a.append(temp)

a = ghtree.list_to_tree(a)
# ---------- end python_8 ----------
subset_2 = SubList(List=python_7.pd, Domain=dom_2, Wrap=True)  # -> List, Index
duppt_5 = RemoveDuplicatePts(Points=pt_18, Tolerance=6)
cull_18 = CullPattern(List=cull_16, CullPattern=subset_2.List)
flatten_4 = FlattenTree(Tree=python_8.a, Path="{0}")
intcrv_3 = Interpolate(Vertices=cull_18, Degree=3, Periodic=True, KnotStyle=1)  # -> Curve, Length, Domain
pline_12 = PolyLine(Vertices=duppt_5, Closed=True)
divide_3 = DivideCurve(Curve=smoothpline_3, Count=100, Kinks=False)  # -> Points, Tangents, Parameters
offset_3 = OffsetCurve(Curve=pline_12, Distance=10, Plane=PlaneXY(0, 0, 0), Corners=1)
nurbs = NurbsCurve(Vertices=divide_3.Points, Degree=3, Periodic=True)  # -> Curve, Length, Domain
grid_divisions = Integer(20)
x_bounds = Domain(Domain(1950, 3650))
y_bounds = Domain(Domain(2750, 3550))
dom² = Domain²(DomainU=x_bounds, DomainV=y_bounds)

pline_13 = PolyLine(Vertices=duppt_5, Closed=True)

incurve = PointInCurve(Point=duppt, Curve=pline_13)  # -> Relationship, Point
equals_2 = Equality(FirstNumber=incurve.Relationship, SecondNumber=2)  # -> Equality, Inequality
cull_19 = CullPattern(List=duppt, CullPattern=equals_2.Equality)
hull = ConvexHull(Points=cull_19, Plane=PlaneXY(0, 0, 0))  # -> Hull, HullZ, Indices
runion = RegionUnion(Curves=flatten([hull.Hull, nurbs.Curve]))
runion_2 = RegionUnion(Curves=flatten(runion))
divide_4 = DivideCurve(Curve=runion, Count=30, Kinks=False)  # -> Points, Tangents, Parameters
runion_3 = RegionUnion(Curves=flatten(runion_2))
rint = RegionIntersection(CurvesA=runion_3, CurvesB=offset_3)
crv_cp_9 = CurveClosestPoint(Point=duppt_5, Curve=rint)  # -> Point, Parameter, Distance
pline_14 = PolyLine(Vertices=crv_cp_9.Point, Closed=True)
divide_5 = DivideCurve(Curve=pline_14, Count=30, Kinks=False)  # -> Points, Tangents, Parameters
intcrv_4 = Interpolate(Vertices=divide_5.Points, Degree=3, Periodic=True, KnotStyle=1)  # -> Curve, Length, Domain
ln_7 = Line(StartPoint=duppt_5, EndPoint=crv_cp_9.Point)
end_10 = EndPoints(Curve=ln_7)  # -> Start, End
duppt_6 = RemoveDuplicatePts(Points=end_10.End, Tolerance=5)
cp_4 = ClosestPoint(Point=end_10.End, Cloud=duppt_6)  # -> ClosestPoint, CPIndex, Distance
crv_cp_10 = CurveClosestPoint(Point=cp_4.ClosestPoint, Curve=intcrv_4.Curve)  # -> Point, Parameter, Distance
nurbs_2 = NurbsCurve(Vertices=divide_4.Points, Degree=3, Periodic=True)  # -> Curve, Length, Domain

pline_15 = PolyLine(Vertices=crv_cp_10.Point, Closed=True)
ln_8 = Line(StartPoint=end_10.Start, EndPoint=crv_cp_10.Point)

cluster = Cluster(crv=pline_13, crv_2=ln_8, crv_3=pline_15)  # -> crv_12, crv_11, crv_10
cluster_2 = Cluster(crv=cluster.crv_12, crv_2=cluster.crv_11, crv_3=cluster.crv_10)  # -> crv_12, crv_11, crv_10
cluster_3 = Cluster(crv=cluster_2.crv_12, crv_2=cluster_2.crv_11, crv_3=cluster_2.crv_10)  # -> crv_12, crv_11, crv_10
crv_5 = Curve(cluster_3.crv_10)
incurve_2 = PointInCurve(Point=flatten_4, Curve=crv_5)  # -> Relationship, Point
explode_4 = Explode(Curve=crv_5, Recursive=True)  # -> Segments, Vertices
equals_3 = Equality(FirstNumber=incurve_2.Relationship, SecondNumber=2)  # -> Equality, Inequality
cull_20 = CullPattern(List=flatten_4, CullPattern=equals_3.Equality)
duppt_7 = RemoveDuplicatePts(Points=explode_4.Vertices, Tolerance=0.01)
duppt_8 = RemoveDuplicatePts(Points=cull_20, Tolerance=4)
crv_cp_11 = CurveClosestPoint(Point=duppt_8, Curve=crv_5)  # -> Point, Parameter, Distance
larger_9 = LargerThan(FirstNumber=crv_cp_11.Distance, SecondNumber=5)  # -> LargerThan, OrEqualTo
cull_21 = CullPattern(List=duppt_8, CullPattern=larger_9.LargerThan)
lng_6 = ListLength(List=cull_21)
multiplication_9 = Multiplication(A=lng_6, B=num_2)
round = Round(Number=multiplication_9)  # -> Nearest, Floor, Ceiling
reduce = RandomReduce(List=cull_21, Reduction=round.Nearest, Seed=1)
merge_11 = Merge(Data1=reduce, Data2=duppt_7)  # -> flatten(Result)
del_3 = DelaunayMesh(Points=merge_11, Plane=PlaneXY(0, 0, 0))
wbedges_3 = WeaverbirdsMeshEdges(MeshOrPolylines=del_3)
curvepoint_3 = PointOnCurve(wbedges_3, parameter=0.5)
incurve_3 = PointInCurve(Point=curvepoint_3, Curve=crv_5)  # -> Relationship, Point
explode_5 = Explode(Curve=cluster_3.crv_12, Recursive=True)  # -> Segments, Vertices
explode_6 = Explode(Curve=cluster_3.crv_10, Recursive=True)  # -> Segments, Vertices
move_6 = Move(Geometry=cluster_3.crv_10, Motion=pt_4)  # -> Geometry, Transform
move_7 = Move(Geometry=cluster_3.crv_11, Motion=pt_4)  # -> Geometry, Transform
move_8 = Move(Geometry=cluster_3.crv_12, Motion=pt_4)  # -> Geometry, Transform
equals_4 = Equality(FirstNumber=incurve_3.Relationship, SecondNumber=2)  # -> Equality, Inequality
scale_2 = Scale(Geometry=move_6.Geometry, Center=pt_4, Factor=division)  # -> Geometry, Transform
scale_3 = Scale(Geometry=move_7.Geometry, Center=pt_4, Factor=division)  # -> Geometry, Transform
scale_4 = Scale(Geometry=move_8.Geometry, Center=pt_4, Factor=division)  # -> Geometry, Transform
cull_22 = CullPattern(List=wbedges_3, CullPattern=equals_4.Equality)
G = ClusterOutput(scale_4.Geometry)
G_2 = ClusterOutput(scale_3.Geometry)
G_3 = ClusterOutput(scale_2.Geometry)
dupln_6 = RemoveDuplicateLines(Lines=cull_22, Tolerance=0.01)
merge_12 = Merge(Data1=dupln_6, Data2=explode_5.Segments, Data3=cluster_3.crv_11, Data4=explode_6.Segments)  # -> flatten(Result)
dupln_7 = RemoveDuplicateLines(Lines=merge_12, Tolerance=0.01)
len_5 = Length(Curve=dupln_7)
move_9 = Move(Geometry=dupln_6, Motion=pt_4)  # -> Geometry, Transform
larger_10 = LargerThan(FirstNumber=len_5, SecondNumber=0.01)  # -> LargerThan, OrEqualTo
scale_5 = Scale(Geometry=move_9.Geometry, Center=pt_4, Factor=division)  # -> Geometry, Transform
cull_23 = CullPattern(List=dupln_7, CullPattern=larger_10.LargerThan)
G_4 = ClusterOutput(scale_5.Geometry)
splitcurves = PythonScript(curves=cull_23, tolerance=Slider(0.001, range=0..0.001))  # -> out, pieces; inputs curves: list of Curve
# ---------- splitcurves: Python ----------
import Rhino
import clr
clr.AddReference("Grasshopper")
from Grasshopper.Kernel.Data import GH_Path
from Grasshopper import DataTree
import ghpythonlib.components as gh


def boxes_overlap(boxA, boxB):
    """Check if there is any overlap between two bounding boxes.
    """
    intersection = boxA.Intersection(boxA, boxB)
    if intersection.IsValid:
        intSize = intersection.Diagonal.Length
        return intSize > 0.0
    else:
        return False

def distribute_intersections(curveIntersections):
    """returns two lists: the parameters on curveA, and the parameters on
    curveB.
    """
    params_a = []
    params_b = []
    for intersection in curveIntersections:
        if not intersection.IsOverlap:
            params_a.append(intersection.ParameterA)
            params_b.append(intersection.ParameterB)
        else: # it's an overlap!
            intervalA = intersection.OverlapA
            intervalB = intersection.OverlapB
            params_a.extend([intervalA.T0, intervalA.T1])
            params_b.extend([intervalB.T0, intervalB.T1])
    return params_a, params_b

def split(curves, tol=0.001):
    """Take a set of curves and split them at every point-type intersection.
    """
    results = []
    parameter_bank = {}
    indices = range(len(curves) - 1, -1, -1)
    for i in indices:
        parameter_bank[i] = []
    for i in indices:
        # check to see if this curve has any previously found intersections
        intersection_parameters = parameter_bank[i]
        if curves:
            curve = curves.pop()
            # check for self intersections first
            self_intersections = Rhino.Geometry.Intersect.Intersection.CurveSelf(curve, tol)
            if self_intersections.Count > 0:
                this_intersect, that_intersect = distribute_intersections(self_intersections)
                intersection_parameters.extend(this_intersect)
                intersection_parameters.extend(that_intersect)
            # check if there are any other curves
            if curves:
                # get the bounding box for this curve
                thisbbox = curve.GetBoundingBox(False)
                # go through the other curves
                for j, other in enumerate(curves):
                    # check if the other curve is anywhere near this one
                    otherbbox = other.GetBoundingBox(False)
                    if boxes_overlap(thisbbox, otherbbox):
                        # get the intersections with the other curve
                        other_intersections = Rhino.Geometry.Intersect.Intersection.CurveCurve( curve,
                                other, tol, tol)
                        if other_intersections.Count > 0:
                            this_intersect, that_intersect = distribute_intersections(other_intersections)
                            intersection_parameters.extend(this_intersect)
                            parameter_bank[j].extend(that_intersect)
        if intersection_parameters:
            # chop up the curve
            curve_pieces = curve.Split(intersection_parameters)
            for curvesss in curve_pieces:
                results.append(gh.Line(curvesss.PointAtStart,curvesss.PointAtEnd))
        else:
            results.append(curve)
    return results

if curves:
    if tolerance == None:
        tolerance = 0.001
    pieces = split(curves, tolerance)
# ---------- end splitcurves ----------
dupln_8 = RemoveDuplicateLines(Lines=splitcurves.pieces, Tolerance=0.01)
len_6 = Length(Curve=dupln_8)
larger_11 = LargerThan(FirstNumber=len_6, SecondNumber=0.01)  # -> LargerThan, OrEqualTo
cull_24 = CullPattern(List=dupln_8, CullPattern=larger_11.LargerThan)
crv_6 = Curve(cull_24)
crv_7 = Curve(simplify(crv_6))
hem_open_xy_networks = VBScript(seg=crv_7, bnd=dom², sbdv=grid_divisions)  # -> out, flatten(e), flatten(eOV), flatten(ePE), flatten(eNE), flatten(eTE), flatten(eIF), flatten(v)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; inputs seg: list of Curve; same code as hem_open_xy_networks
pline_16 = PolyLine(Vertices=hem_open_xy_networks.f, Closed=True)
flatten_5 = FlattenTree(Tree=pline_16, Path="{0}")
srf_2 = Surface(flatten_5)
area_5 = Area(Geometry=srf_2)  # -> Area, Centroid
sort_4 = SortList(Keys=area_5.Area, ValuesA=flatten_5)  # -> Keys, ValuesA
shift = ShiftList(List=sort_4.ValuesA, Shift=-1, Wrap=False)
explode_7 = Explode(Curve=shift, Recursive=True)  # -> Segments, simplify(Vertices)
shift_2 = ShiftList(List=explode_7.Vertices, Shift=1, Wrap=False)  # -> simplify(List)
path_mapper = PathMapper(shift_2, source="{a}", target="{0;a}")
pt_19 = Point(path_mapper)

# ---- group: 迭代更新凹多边形顶点
python_9 = GhPythonScript(pts=pt_19, run=bool_2)  # -> out, a, count, loops; inputs pts: tree of Point3d, run: Boolean
# ---------- python_9: Python ----------
__author__ = "Platina"
__version__ = "2019.11.23"

import rhinoscriptsyntax as rs
import ghpythonlib.components as gh
import ghpythonlib.treehelpers as ghtree
import math

if run:
    
    pts = ghtree.tree_to_list(pts)
    
    loops = 0
    while True:
        count = 0
        for i in range(len(pts)):
            j = 0
            while j<len(pts[i]):
                q = j - 1
                p = j + 1
                if q<0:
                    q = len(pts[i])-1
                if p>len(pts[i])-1:
                    p = 0
                pt1 = pts[i][q]
                pt2 = gh.ConstructPoint(pts[i][j][0],pts[i][j][1],pts[i][j][2])
                pt3 = pts[i][p]
                vec1 = gh.UnitVector(pt2 - pt1)
                vec2 = gh.UnitVector(pt3 - pt2)
                if (gh.VectorLength(vec1)!=0) and (gh.VectorLength(vec2)!=0):
                    ang = rs.VectorAngle(vec1,vec2)
                    cro = rs.VectorCrossProduct(vec1,vec2)
                    if (ang<3) or (cro[2]>0):
                        count = count + 1
                        vec3 = gh.UnitVector(pt1 - pt2)
                        vec = gh.UnitVector(vec3+vec2)
                        if (cro[2]<0):
                            vec = gh.Reverse(vec)
                        elif (cro[2]==0):
                            vec = gh.Rotate(vec1,math.pi/2,gh.XYPlane())
                        vec = gh.UnitVector(vec) * 1.111111
                        for ii in range(len(pts)):
                            for jj in range(len(pts[ii])):
                                if rs.Distance(pts[ii][jj],pt2)<0.01:
                                    pts[ii][jj] = pt2 + vec
                j = j + 1
        if count==0:
            break
        if loops>=100:
            break
        loops = loops + 1
    
    a = ghtree.list_to_tree(pts)
# ---------- end python_9 ----------

# ----
pline_17 = PolyLine(Vertices=python_9.a, Closed=True)  # -> flatten(Polyline)
explode_8 = Explode(Curve=pline_17, Recursive=True)  # -> flatten(Segments), Vertices
dupln_9 = RemoveDuplicateLines(Lines=explode_8.Segments, Tolerance=0.01)
move_10 = Move(Geometry=dupln_9, Motion=pt_4)  # -> Geometry, Transform
scale_6 = Scale(Geometry=move_10.Geometry, Center=pt_4, Factor=division)  # -> Geometry, Transform
G_5 = ClusterOutput(scale_6.Geometry)

# ==== cluster Generate_ForceDragonflyWingFc2_1to7Smooth
pt = ClusterInput()
pt_2 = ClusterInput()
txt = ClusterInput()
pt_3 = ClusterInput()
bool = ClusterInput()
pt_4 = Point(pt)
pt_5 = Point(pt_2)
txt_2 = Text(txt)
pt_6 = Point(pt_3)
bool_2 = Boolean(bool)
generate_force_geometry = GhPythonScript(pt1=pt_4, file_path=txt_2, run=bool_2)  # -> out, file_path_blacklines, file_path_redske, file_path_img, file_path_bou, file_path_internal_bou; inputs pt1: Point3d, run: Boolean; same code as generate_force_geometry
dist = Distance(PointA=pt_6, PointB=pt_4)
pdecon = Deconstruct(Point=pt_5)  # -> XComponent, YComponent, ZComponent
pdecon_2 = Deconstruct(Point=pt_4)  # -> XComponent, YComponent, ZComponent
division = Division(A=dist, B=1024)
subtraction = Subtraction(A=pdecon.XComponent, B=pdecon_2.XComponent)
python = GhPythonScript(filename=generate_force_geometry.file_path_img, tor_r=Slider(100, range=0..255))  # -> out, b; same code as python
python_2 = GhPythonScript(filename=generate_force_geometry.file_path_img, tor_g=Slider(0.75, range=0..1), tor_b=Slider(180, range=0..255))  # -> out, b; same code as python_2
file = ReadFile(File=generate_force_geometry.file_path_bou, PerLineParse=True)
file_2 = ReadFile(File=generate_force_geometry.file_path_internal_bou, PerLineParse=True)
file_3 = ReadFile(File=generate_force_geometry.file_path_redske, PerLineParse=True)
file_4 = ReadFile(File=generate_force_geometry.file_path_blacklines, PerLineParse=True)
division_2 = Division(A=subtraction, B=24)
split = TextSplit(Text=file, Separators=",")
split_2 = TextSplit(Text=file_2, Separators=",")
item = ListItem(List=python.b, Index=0, Wrap=True)  # -> Item, Item1, Item2
split_3 = TextSplit(Text=file_3, Separators=",")  # -> simplify(Result)
split_4 = TextSplit(Text=file_4, Separators=",")  # -> simplify(Result)
item_2 = ListItem(List=python_2.b, Index=0, Wrap=True)  # -> Item, Item1, Item2
neg = Negative(Value=division_2)
pt_7 = ConstructPoint(XCoordinate=0, YCoordinate=256, ZCoordinate=0)
item_3 = ListItem(List=split, Index=0, Wrap=True)  # -> Item, Item1
item_4 = ListItem(List=split_2, Index=0, Wrap=True)  # -> Item, Item1
pt_8 = ConstructPoint(XCoordinate=item.Item, YCoordinate=item.Item1, ZCoordinate=0)  # -> flatten(Point)
split_5 = TextSplit(Text=split_3, Separators=" ")  # -> simplify(Result)
pt_9 = ConstructPoint(XCoordinate=item_2.Item, YCoordinate=item_2.Item1, ZCoordinate=0)  # -> flatten(Point)
split_6 = TextSplit(Text=split_4, Separators=" ")  # -> simplify(Result)
flatten = FlattenTree(Tree=item_2.Item2, Path="{0}")
X = UnitX(Factor=neg)
xz = XZPlane(Origin=pt_7)
pt_10 = ConstructPoint(XCoordinate=item_3.Item, YCoordinate=item_3.Item1, ZCoordinate=0)
pt_11 = ConstructPoint(XCoordinate=item_4.Item, YCoordinate=item_4.Item1, ZCoordinate=0)
duppt = RemoveDuplicatePts(Points=pt_9, Tolerance="6")
split_7 = TextSplit(Text=split_5, Separators=" .")  # -> simplify(Result)
split_8 = TextSplit(Text=split_6, Separators=" .")  # -> simplify(Result)
division_3 = Division(A="6", B=2)
mirror = Mirror(Geometry=pt_10, Plane=xz)  # -> flatten(Geometry), Transform
mirror_2 = Mirror(Geometry=pt_11, Plane=xz)  # -> flatten(Geometry), Transform
cir = Circle(Plane=duppt, Radius=division_3)
trim = TrimTree(Tree=split_7, Depth=1)
trim_2 = TrimTree(Tree=split_8, Depth=1)
pline = PolyLine(Vertices=mirror.Geometry, Closed=False)
incurves = PointInCurves(Point=pt_9, Curves=cir)  # -> Relationship, Index, Point
pline_2 = PolyLine(Vertices=mirror_2.Geometry, Closed=False)
split_9 = TextSplit(Text=trim, Separators="[")  # -> simplify(Result)
split_10 = TextSplit(Text=trim_2, Separators="[")  # -> simplify(Result)
python_3 = GhPythonScript(x=incurves.Index, y=pt_9, z=flatten)  # -> out, a, b; inputs x: list, y: list, z: list; same code as python_3

avr = Average(Input=python_3.b)  # -> flatten(ArithmeticMean)
avr_2 = Average(Input=python_3.a)  # -> flatten(ArithmeticMean)

trim_3 = TrimTree(Tree=split_9, Depth=1)
trim_4 = TrimTree(Tree=split_10, Depth=1)
division_4 = Division(A=avr, B="255")
split_11 = TextSplit(Text=trim_3, Separators="]")  # -> simplify(Result)
split_12 = TextSplit(Text=trim_4, Separators="]")  # -> simplify(Result)
multiplication = Multiplication(A=division_4, B="1500")
trim_5 = TrimTree(Tree=split_11, Depth=1)
trim_6 = TrimTree(Tree=split_12, Depth=1)
multiplication_2 = Multiplication(A=multiplication, B=Slider(0.29, range=0..1))
division_5 = Division(A=multiplication_2, B="10000")
multiplication_3 = Multiplication(A=division_5, B="1024")
max = Maximum(A=multiplication_3, B=0.1)
cir_2 = Circle(Plane=avr_2, Radius=max)
num = Number(trim_6)
num_2 = Number(trim_5)
null = NullItem(Item=num_2)  # -> NullFlags, InvalidFlags, Description
null_2 = NullItem(Item=num)  # -> NullFlags, InvalidFlags, Description
not = GateNot(A=null.NullFlags)
not_2 = GateNot(A=null_2.NullFlags)
cull = CullPattern(List=num_2, CullPattern=not)
cull_2 = CullPattern(List=num, CullPattern=not_2)
item_5 = ListItem(List=cull_2, Index=0, Wrap=True)  # -> Item, Item1
item_6 = ListItem(List=cull, Index=0, Wrap=True)  # -> Item, Item1
pt_12 = ConstructPoint(XCoordinate=0, YCoordinate=256, ZCoordinate=0)
pt_13 = ConstructPoint(XCoordinate=0, YCoordinate=256, ZCoordinate=0)
pt_14 = ConstructPoint(XCoordinate=item_6.Item1, YCoordinate=item_6.Item, ZCoordinate=0)

pt_15 = ConstructPoint(XCoordinate=512, YCoordinate=256, ZCoordinate=0)  # disabled
xz_2 = XZPlane(Origin=pt_15)  # disabled
number_slider = Slider(5, range=0..10)  # disabled
mirror_3 = Mirror(Geometry=pt_14, Plane=xz_2)  # -> Geometry, Transform; disabled
trim_7 = TrimTree(Tree=mirror_3.Geometry, Depth=1)  # disabled
cp = ClosestPoint(Point=mirror_3.Geometry, Cloud=avr_2)  # -> ClosestPoint, CPIndex, Distance; disabled
pline_3 = PolyLine(Vertices=trim_7, Closed=False)  # disabled
end = EndPoints(Curve=pline_3)  # -> Start, End; disabled
smaller = SmallerThan(FirstNumber=cp.Distance, SecondNumber=number_slider)  # -> SmallerThan, OrEqualTo; disabled
flatten_2 = FlattenTree(Tree=pline_3, Path="{0}")  # disabled
end_2 = EndPoints(Curve=pline_3)  # -> Start, End; disabled
ln = Line(StartPoint=end.Start, EndPoint=end.End)  # disabled
cull_3 = CullPattern(List=mirror_3.Geometry, CullPattern=smaller.SmallerThan)  # disabled
cull_4 = CullPattern(List=cp.CPIndex, CullPattern=smaller.SmallerThan)  # disabled
crv_cp = CurveClosestPoint(Point=end_2.Start, Curve=flatten_2)  # -> Point, Parameter, Distance; disabled
crv_cp_2 = CurveClosestPoint(Point=end_2.End, Curve=flatten_2)  # -> Point, Parameter, Distance; disabled
trim_8 = TrimTree(Tree=cull_3, Depth=1)  # disabled
trim_9 = TrimTree(Tree=cull_4, Depth=1)  # disabled
item_7 = ListItem(List=trim_9, Index=0, Wrap=True)  # -> Item1, Item; disabled
merge = Merge(Data1=item_7.Item, Data2=trim_9, Data3=item_7.Item1)  # disabled
merge_2 = Merge(Data1=end.Start, Data2=trim_8, Data3=end.End)  # disabled
smaller_2 = SmallerThan(FirstNumber=crv_cp.Distance, SecondNumber=3)  # -> SmallerThan, OrEqualTo; disabled
smaller_3 = SmallerThan(FirstNumber=crv_cp_2.Distance, SecondNumber=3)  # -> SmallerThan, OrEqualTo; disabled
null_3 = NullItem(Item=merge)  # -> NullFlags, InvalidFlags, Description; disabled
or = GateOr(A=smaller_2.SmallerThan, B=smaller_3.SmallerThan)  # disabled
not_3 = GateNot(A=null_3.NullFlags)  # disabled
not_4 = GateNot(A=or)  # disabled
cull_5 = CullPattern(List=merge_2, CullPattern=not_3)  # disabled
flatten_3 = FlattenTree(Tree=cull_5, Path="{0}")  # disabled
lng = ListLength(List=cull_5)  # disabled
graft = GraftTree(Tree=flatten_3, IncludeEmptyLists=True, IncludeNullItems=True)  # -> simplify(Tree); disabled
crv_cp_3 = CurveClosestPoint(Point=graft, Curve=flatten_2)  # -> Point, Parameter, Distance; disabled
larger = LargerThan(FirstNumber=lng, SecondNumber=2)  # -> LargerThan, flatten(OrEqualTo); disabled
cull_6 = CullPattern(List=merge, CullPattern=not_3)  # disabled
and = GateAnd(A=not_4, B=larger.OrEqualTo)  # disabled
item_8 = ListItem(List=max, Index=cull_6, Wrap=True)  # disabled
crv_cp_4 = CurveClosestPoint(Point=cull_5, Curve=pline_3)  # -> Point, Parameter, Distance; disabled
dup = DuplicateData(Data=and, Number=lng, Order=True)  # -> simplify(Data); disabled
unflatten = UnflattenTree(Tree=dup, Guide=crv_cp_3.Distance)  # disabled
cir_3 = Circle(Plane=cull_5, Radius=item_8)  # disabled
eval = EvaluateCurve(Curve=pline_3, Parameter=crv_cp_4.Parameter)  # -> Point, Tangent, Angle; disabled
cull_7 = CullPattern(List=crv_cp_3.Distance, CullPattern=unflatten)  # disabled
rotate = Rotate(Geometry=eval.Tangent, Angle=1.570796327, Plane=PlaneXY(0, 0, 0))  # -> Geometry, Transform; disabled
sort = SortList(Keys=cull_7)  # -> Keys, ValuesA; disabled
unit = UnitVector(Vector=rotate.Geometry)  # disabled
item_9 = ListItem(List=sort.Keys, Index=0, Wrap=True)  # -> flatten(Item); disabled
division_6 = Division(A=item_9, B=2)  # disabled
multiplication_4 = Multiplication(A=division_6, B=1)  # disabled
unflatten_2 = UnflattenTree(Tree=multiplication_4, Guide=item_8)  # disabled
min = Minimum(A=unflatten_2, B=item_8)  # disabled
multiplication_5 = Multiplication(A=unit, B=min)  # disabled
neg_2 = Negative(Value=multiplication_5)  # disabled
move = Move(Geometry=cull_5, Motion=multiplication_5)  # -> Geometry, Transform; disabled
move_2 = Move(Geometry=cull_5, Motion=neg_2)  # -> Geometry, Transform; disabled
item_10 = ListItem(List=move_2.Geometry, Index=0, Wrap=True)  # -> Item1, Item; disabled
item_11 = ListItem(List=move.Geometry, Index=0, Wrap=True)  # -> Item1, Item; disabled
ln_2 = Line(StartPoint=item_11.Item1, EndPoint=item_10.Item1)  # disabled
ln_3 = Line(StartPoint=item_11.Item, EndPoint=item_10.Item)  # disabled
pline_4 = PolyLine(Vertices=move.Geometry, Closed=False)  # disabled
pline_5 = PolyLine(Vertices=move_2.Geometry, Closed=False)  # disabled
cir_4 = Circle(Plane=cull_5, Radius=min)  # disabled

pt_16 = ConstructPoint(XCoordinate=item_5.Item1, YCoordinate=item_5.Item, ZCoordinate=0)
xz_3 = XZPlane(Origin=pt_12)
xz_4 = XZPlane(Origin=pt_13)
mirror_4 = Mirror(Geometry=pt_14, Plane=xz_3)  # -> Geometry, Transform
mirror_5 = Mirror(Geometry=pt_16, Plane=xz_4)  # -> Geometry, Transform
trim_10 = TrimTree(Tree=mirror_4.Geometry, Depth=1)
pline_6 = PolyLine(Vertices=trim_10, Closed=False)  # -> flatten(Polyline)
trim_11 = TrimTree(Tree=mirror_5.Geometry, Depth=1)
end_3 = EndPoints(Curve=pline_6)  # -> Start, End
pline_7 = PolyLine(Vertices=trim_11, Closed=False)  # -> flatten(Polyline)
end_4 = EndPoints(Curve=pline_7)  # -> Start, End
graft_2 = GraftTree(Tree=end_3.End, IncludeEmptyLists=True, IncludeNullItems=True)
graft_3 = GraftTree(Tree=end_4.End, IncludeEmptyLists=True, IncludeNullItems=True)
smoothpline = SmoothPolyline(Polyline=pline_7, Strength=1, Times=Slider(1000, range=0..1000))
smoothpline_2 = SmoothPolyline(Polyline=pline_7, Strength=1, Times=Slider(100, range=0..1000))
divlength = DivideLength(Curve=pline_6, Length=50)  # -> Points, Tangents, Parameters
divlength_2 = DivideLength(Curve=pline_7, Length=50)  # -> Points, Tangents, Parameters
len = Length(Curve=smoothpline)
merge_3 = Merge(Data1=divlength.Points, Data2=graft_2)
merge_4 = Merge(Data1=divlength_2.Points, Data2=graft_3)
larger_2 = LargerThan(FirstNumber=len, SecondNumber=8)  # -> LargerThan, OrEqualTo
pline_8 = PolyLine(Vertices=merge_3, Closed=False)  # -> flatten(Polyline)
pline_9 = PolyLine(Vertices=merge_4, Closed=False)  # -> flatten(Polyline)
cull_8 = CullPattern(List=smoothpline, CullPattern=larger_2.LargerThan)
explode = Explode(Curve=pline_8, Recursive=True)  # -> flatten(Segments), Vertices
explode_2 = Explode(Curve=pline_9, Recursive=True)  # -> flatten(Segments), Vertices
len_2 = Length(Curve=explode.Segments)
len_3 = Length(Curve=explode_2.Segments)
larger_3 = LargerThan(FirstNumber=len_2, SecondNumber=0.01)  # -> LargerThan, OrEqualTo
larger_4 = LargerThan(FirstNumber=len_3, SecondNumber=0.01)  # -> LargerThan, OrEqualTo
cull_9 = CullPattern(List=explode.Segments, CullPattern=larger_3.LargerThan)
graft_4 = GraftTree(Tree=avr_2, IncludeEmptyLists=True, IncludeNullItems=True)
cull_10 = CullPattern(List=explode_2.Segments, CullPattern=larger_4.LargerThan)
dupln = RemoveDuplicateLines(Lines=cull_9, Tolerance=0.01)
crv_cp_5 = CurveClosestPoint(Point=graft_4, Curve=dupln)  # -> Point, Parameter, Distance
dupln_2 = RemoveDuplicateLines(Lines=cull_10, Tolerance=0.01)
crv = Curve(dupln_2)
remove_1 = Remove1(C=crv)
curvepoint = PointOnCurve(remove_1, parameter=0.5)
scale = Scale(Geometry=remove_1, Center=curvepoint, Factor=2)  # -> Geometry, Transform
crv_2 = Curve(scale.Geometry)
end_5 = EndPoints(Curve=crv_2)  # -> Start, End
merge_5 = Merge(Data1=end_5.Start, Data2=end_5.End)
vec2pt = Vector2Pt(PointA=end_5.Start, PointB=end_5.End, Unitize=False)  # -> Vector, Length
remove_1_2 = Remove1(C=remove_1)
duppt_2 = RemoveDuplicatePts(Points=merge_5, Tolerance=0.01)
remove_1_3 = Remove1(C=remove_1_2)
remove_1_4 = Remove1(C=remove_1_3)
remove_1_5 = Remove1(C=remove_1_4)
remove_1_6 = Remove1(C=remove_1_5)
remove_1_7 = Remove1(C=remove_1_6)
remove_1_8 = Remove1(C=remove_1_7)
end_6 = EndPoints(Curve=remove_1_8)  # -> Start, End
merge_6 = Merge(Data1=end_6.Start, Data2=end_6.End)
duppt_3 = RemoveDuplicatePts(Points=merge_6, Tolerance=0.01)
del = DelaunayMesh(Points=duppt_3, Plane=PlaneXY(0, 0, 0))
wbedges = WeaverbirdsMeshEdges(MeshOrPolylines=del)
dupln_3 = RemoveDuplicateLines(Lines=wbedges, Tolerance=0.01)
len_4 = Length(Curve=dupln_3)
smaller_4 = SmallerThan(FirstNumber=len_4, SecondNumber=60)  # -> SmallerThan, OrEqualTo
curvepoint_2 = PointOnCurve(dupln_3, parameter=0.5)
cp_2 = ClosestPoint(Point=curvepoint_2, Cloud=duppt_3)  # -> ClosestPoint, CPIndex, Distance
smaller_5 = SmallerThan(FirstNumber=cp_2.Distance, SecondNumber=30)  # -> SmallerThan, OrEqualTo
and_2 = GateAnd(A=smaller_5.SmallerThan, B=smaller_4.SmallerThan)
cull_11 = CullPattern(List=dupln_3, CullPattern=and_2)
merge_7 = Merge(Data1=cull_11, Data2=remove_1_8)  # -> flatten(Result)
dupln_4 = RemoveDuplicateLines(Lines=merge_7, Tolerance=0.01)
wbweave = WeaverbirdsMeshFromLinesWeaveBack(Lines=dupln_4, MaximumValence=1000)
explode_3 = MeshExplode(Mesh=wbweave, Interpolate=False)
end_7 = EndPoints(Curve=dupln_4)  # -> Start, End
wbedges_2 = WeaverbirdsMeshEdges(MeshOrPolylines=explode_3)
merge_8 = Merge(Data1=end_7.Start, Data2=end_7.End)
dupln_5 = RemoveDuplicateLines(Lines=wbedges_2, Tolerance=0.01)
boundary = BoundarySurfaces(Edges=dupln_5)
debrep = DeconstructBrep(Brep=boundary)  # -> Faces, Edges, Vertices
pline_10 = PolyLine(Vertices=debrep.Vertices, Closed=True)
boundary_2 = BoundarySurfaces(Edges=pline_10)  # -> flatten(Surfaces)
duppt_4 = RemoveDuplicatePts(Points=merge_8, Tolerance=0.01)
del_2 = DelaunayMesh(Points=duppt_4, Plane=PlaneXY(0, 0, 0))
wbnaked = WeaverbirdsNakedBoundary(MeshClosedPolylines=del_2)
merge_9 = Merge(Data1=flatten(wbnaked), Data2=flatten(boundary_2))
item_12 = ListItem(List=merge_9, Index=1, Wrap=True)
area = Area(Geometry=item_12)  # -> Area, Centroid
sort_2 = SortList(Keys=area.Area, ValuesA=item_12)  # -> Keys, ValuesA
item_13 = ListItem(List=sort_2.ValuesA, Index=-1, Wrap=True)
crv_3 = Curve(item_13)
divlength_3 = DivideLength(Curve=item_13, Length=10)  # -> Points, Tangents, Parameters
lng_2 = ListLength(List=divlength_3.Points)
dup_2 = DuplicateData(Data=divlength_3.Points, Number=2, Order=True)
subtraction_2 = Subtraction(A=lng_2, B=1)
dom = ConstructDomain(DomainStart=0, DomainEnd=subtraction_2)
python_4 = GhPythonScript(x=dup_2)  # -> out, pd; inputs x: list of Point3d; same code as python_4
subset = SubList(List=python_4.pd, Domain=dom, Wrap=True)  # -> List, Index
cull_12 = CullPattern(List=divlength_3.Points, CullPattern=subset.List)
intcrv = Interpolate(Vertices=cull_12, Degree=3, Periodic=True, KnotStyle=1)  # -> Curve, Length, Domain
area_2 = Area(Geometry=intcrv.Curve)  # -> Area, Centroid
cir_5 = Circle(Plane=area_2.Centroid, Radius=1)
flip = FlipCurve(Curve=cir_5)  # -> Curve, Flag
flip_2 = FlipCurve(Curve=intcrv.Curve, Guide=flip.Curve)  # -> Curve, Flag
divide = DivideCurve(Curve=intcrv.Curve, Count=15, Kinks=False)  # -> Points, Tangents, Parameters
srf = Surface(flip_2.Curve)
divide_2 = DivideCurve(Curve=srf, Count=1000, Kinks=False)  # -> Points, Tangents, Parameters
intcrv_2 = Interpolate(Vertices=divide.Points, Degree=3, Periodic=True, KnotStyle=1)  # -> Curve, Length, Domain
flip_3 = FlipCurve(Curve=intcrv_2.Curve)  # -> Curve, Flag
offset = OffsetCurve(Curve=intcrv_2.Curve, Distance=10, Plane=PlaneXY(0, 0, 0), Corners=1)
offset_2 = OffsetCurve(Curve=intcrv_2.Curve, Distance=-10, Plane=PlaneXY(0, 0, 0), Corners=1)
area_3 = Area(Geometry=offset_2)  # -> Area, Centroid
area_4 = Area(Geometry=offset)  # -> Area, Centroid
merge_10 = Merge(Data1=intcrv_2.Curve, Data2=flip_3.Curve)
crv_4 = Curve(flip_2.Curve)
larger_5 = LargerThan(FirstNumber=area_4.Area, SecondNumber=area_3.Area)  # -> LargerThan, OrEqualTo
item_14 = ListItem(List=merge_10, Index=larger_5.LargerThan, Wrap=True)
crv_cp_6 = CurveClosestPoint(Point=divide_2.Points, Curve=item_14)  # -> Point, Parameter, Distance
eval_2 = EvaluateCurve(Curve=item_14, Parameter=crv_cp_6.Parameter)  # -> Point, Tangent, Angle
rotate_2 = Rotate(Geometry=eval_2.Tangent, Angle=-1.570796327, Plane=PlaneXY(0, 0, 0))  # -> Geometry, Transform
multiplication_6 = Multiplication(A=rotate_2.Geometry, B=300)
move_3 = Move(Geometry=divide_2.Points, Motion=multiplication_6)  # -> Geometry, Transform
ln_4 = Line(StartPoint=divide_2.Points, EndPoint=move_3.Geometry)
python_5 = GhPythonScript(a=ln_4, b=crv_2, crv=crv_4)  # -> out, c; inputs a: list of Curve, b: list of Curve, crv: Curve; same code as python_5
ln_5 = Line(StartPoint=divide_2.Points, EndPoint=python_5.c)
ccx = CurveCurve(CurveA=ln_5, CurveB=crv_4)  # -> Points, ParamsA, ParamsB
lng_3 = ListLength(List=ccx.Points)
equals = Equality(FirstNumber=lng_3, SecondNumber=1)  # -> flatten(Equality), Inequality
cull_13 = CullPattern(List=ln_5, CullPattern=equals.Equality)
vec2pt_2 = Vector2Pt(PointA=divide_2.Points, PointB=python_5.c, Unitize=False)  # -> Vector, Length
graft_5 = GraftTree(Tree=ln_5, IncludeEmptyLists=True, IncludeNullItems=True)
lng_4 = ListLength(List=dupln)
number_slider_2 = Slider(45, range=0..100)
graft_6 = GraftTree(Tree=vec2pt_2.Vector, IncludeEmptyLists=True, IncludeNullItems=True)
crvprox = CurveProximity(CurveA=graft_5, CurveB=crv_2)  # -> PointA, PointB, Distance
angle = Angle(VectorA=graft_6, VectorB=vec2pt.Vector)  # -> simplify(Angle), Reflex
series = Series(Start=0, Step=1, Count=lng_4)
sort_3 = SortList(Keys=crv_cp_5.Distance, ValuesA=series, ValuesB=crv_cp_5.Point)  # -> Keys, ValuesA, ValuesB
subtraction_3 = Subtraction(A=180, B=number_slider_2)
item_15 = ListItem(List=sort_3.ValuesA, Index=0, Wrap=True)  # -> flatten(Item)
item_16 = ListItem(List=sort_3.ValuesB, Index=0, Wrap=True)  # -> flatten(Item)
smaller_6 = SmallerThan(FirstNumber=crvprox.Distance, SecondNumber=Slider(3, range=0..10))  # -> SmallerThan, OrEqualTo
rad = Radians(Degrees=subtraction_3)
larger_6 = LargerThan(FirstNumber=angle.Angle, SecondNumber=rad)  # -> LargerThan, OrEqualTo
item_17 = ListItem(List=dupln, Index=item_15, Wrap=True)
rad_2 = Radians(Degrees=number_slider_2)
smaller_7 = SmallerThan(FirstNumber=angle.Angle, SecondNumber=rad_2)  # -> SmallerThan, OrEqualTo
or_2 = GateOr(A=smaller_7.SmallerThan, B=larger_6.LargerThan)
crv_cp_7 = CurveClosestPoint(Point=item_16, Curve=item_17)  # -> Point, Parameter, Distance
and_3 = GateAnd(A=or_2, B=smaller_6.SmallerThan)
eval_3 = EvaluateCurve(Curve=item_17, Parameter=crv_cp_7.Parameter)  # -> Point, Tangent, Angle
ma = MassAddition(Input=and_3)  # -> flatten(Result), PartialResults
rotate_3 = Rotate(Geometry=eval_3.Tangent, Angle=1.570796327, Plane=PlaneXY(0, 0, 0))  # -> Geometry, Transform
larger_7 = LargerThan(FirstNumber=ma.Result, SecondNumber=0)  # -> LargerThan, OrEqualTo
unit_2 = UnitVector(Vector=rotate_3.Geometry)
cull_14 = CullPattern(List=ln_5, CullPattern=larger_7.LargerThan)
multiplication_7 = Multiplication(A=unit_2, B=100)
multiplication_8 = Multiplication(A=unit_2, B=-200)
end_8 = EndPoints(Curve=cull_14)  # -> Start, End
move_4 = Move(Geometry=avr_2, Motion=multiplication_7)  # -> Geometry, Transform
python_6 = GhPythonScript(x=cull_14)  # -> out, pd; inputs x: list of Curve; same code as python_6
move_5 = Move(Geometry=move_4.Geometry, Motion=multiplication_8)  # -> Geometry, Transform
cull_15 = CullPattern(List=cull_14, CullPattern=python_6.pd)
ln_6 = Line(StartPoint=move_4.Geometry, EndPoint=move_5.Geometry)
end_9 = EndPoints(Curve=cull_15)  # -> Start, End
pt_17 = Point(end_9.End)
crv_cp_8 = CurveClosestPoint(Point=pt_17, Curve=srf)  # -> Point, Parameter, Distance
cp_3 = ClosestPoint(Point=pt_17, Cloud=pt_8)  # -> ClosestPoint, CPIndex, Distance
larger_8 = LargerThan(FirstNumber=crv_cp_8.Distance, SecondNumber=Slider(40, range=0..100))  # -> LargerThan, OrEqualTo
smaller_8 = SmallerThan(FirstNumber=cp_3.Distance, SecondNumber=5)  # -> SmallerThan, OrEqualTo
cull_16 = CullPattern(List=pt_17, CullPattern=larger_8.LargerThan)
graft_7 = GraftTree(Tree=ln_6, IncludeEmptyLists=True, IncludeNullItems=True)
cull_17 = CullPattern(List=pt_17, CullPattern=smaller_8.SmallerThan)
lng_5 = ListLength(List=cull_16)
pline_11 = PolyLine(Vertices=cull_17, Closed=True)
dup_3 = DuplicateData(Data=cull_16, Number=2, Order=True)
subtraction_4 = Subtraction(A=lng_5, B=1)
clx = CurveLine(Curve=cull_8, Line=graft_7)  # -> Points, Params, Count
dom_2 = ConstructDomain(DomainStart=0, DomainEnd=subtraction_4)
python_7 = GhPythonScript(x=dup_3)  # -> out, pd; inputs x: list of Point3d; same code as python_7
trim_12 = TrimTree(Tree=clx.Points, Depth=1)
smoothpline_3 = SmoothPolyline(Polyline=pline_11, Strength=1, Times=3)
pt_18 = Point(end_9.Start)
python_8 = GhPythonScript(x=trim_12, y=avr_2, z=ln_6)  # -> out, a; inputs x: tree of Point3d, y: list of Point3d, z: list of Curve; same code as python_8
subset_2 = SubList(List=python_7.pd, Domain=dom_2, Wrap=True)  # -> List, Index
duppt_5 = RemoveDuplicatePts(Points=pt_18, Tolerance=6)
cull_18 = CullPattern(List=cull_16, CullPattern=subset_2.List)
flatten_4 = FlattenTree(Tree=python_8.a, Path="{0}")
intcrv_3 = Interpolate(Vertices=cull_18, Degree=3, Periodic=True, KnotStyle=1)  # -> Curve, Length, Domain
pline_12 = PolyLine(Vertices=duppt_5, Closed=True)
divide_3 = DivideCurve(Curve=smoothpline_3, Count=100, Kinks=False)  # -> Points, Tangents, Parameters
hull = ConvexHull(Points=duppt, Plane=PlaneXY(0, 0, 0))  # -> Hull, HullZ, Indices
offset_3 = OffsetCurve(Curve=pline_12, Distance=10, Plane=PlaneXY(0, 0, 0), Corners=1)
nurbs = NurbsCurve(Vertices=divide_3.Points, Degree=3, Periodic=True)  # -> Curve, Length, Domain
runion = RegionUnion(Curves=flatten([hull.Hull, nurbs.Curve]))
runion_2 = RegionUnion(Curves=flatten(runion))
divide_4 = DivideCurve(Curve=runion, Count=30, Kinks=False)  # -> Points, Tangents, Parameters
runion_3 = RegionUnion(Curves=flatten(runion_2))
rint = RegionIntersection(CurvesA=runion_3, CurvesB=offset_3)
crv_cp_9 = CurveClosestPoint(Point=duppt_5, Curve=rint)  # -> Point, Parameter, Distance
pline_13 = PolyLine(Vertices=crv_cp_9.Point, Closed=True)
divide_5 = DivideCurve(Curve=pline_13, Count=30, Kinks=False)  # -> Points, Tangents, Parameters
intcrv_4 = Interpolate(Vertices=divide_5.Points, Degree=3, Periodic=True, KnotStyle=1)  # -> Curve, Length, Domain
ln_7 = Line(StartPoint=duppt_5, EndPoint=crv_cp_9.Point)
end_10 = EndPoints(Curve=ln_7)  # -> Start, End
duppt_6 = RemoveDuplicatePts(Points=end_10.End, Tolerance=5)
cp_4 = ClosestPoint(Point=end_10.End, Cloud=duppt_6)  # -> ClosestPoint, CPIndex, Distance
crv_cp_10 = CurveClosestPoint(Point=cp_4.ClosestPoint, Curve=intcrv_4.Curve)  # -> Point, Parameter, Distance
nurbs_2 = NurbsCurve(Vertices=divide_4.Points, Degree=3, Periodic=True)  # -> Curve, Length, Domain

pline_14 = PolyLine(Vertices=duppt_5, Closed=True)
pline_15 = PolyLine(Vertices=crv_cp_10.Point, Closed=True)
ln_8 = Line(StartPoint=end_10.Start, EndPoint=crv_cp_10.Point)

cluster = Cluster(crv=pline_14, crv_2=ln_8, crv_3=pline_15)  # -> crv_12, crv_11, crv_10
cluster_2 = Cluster(crv=cluster.crv_12, crv_2=cluster.crv_11, crv_3=cluster.crv_10)  # -> crv_12, crv_11, crv_10
cluster_3 = Cluster(crv=cluster_2.crv_12, crv_2=cluster_2.crv_11, crv_3=cluster_2.crv_10)  # -> crv_12, crv_11, crv_10
crv_5 = Curve(cluster_3.crv_10)
incurve = PointInCurve(Point=flatten_4, Curve=crv_5)  # -> Relationship, Point
explode_4 = Explode(Curve=crv_5, Recursive=True)  # -> Segments, Vertices
equals_2 = Equality(FirstNumber=incurve.Relationship, SecondNumber=2)  # -> Equality, Inequality
cull_19 = CullPattern(List=flatten_4, CullPattern=equals_2.Equality)
duppt_7 = RemoveDuplicatePts(Points=explode_4.Vertices, Tolerance=0.01)
duppt_8 = RemoveDuplicatePts(Points=cull_19, Tolerance=4)
crv_cp_11 = CurveClosestPoint(Point=duppt_8, Curve=crv_5)  # -> Point, Parameter, Distance
larger_9 = LargerThan(FirstNumber=crv_cp_11.Distance, SecondNumber=5)  # -> LargerThan, OrEqualTo
cull_20 = CullPattern(List=duppt_8, CullPattern=larger_9.LargerThan)
merge_11 = Merge(Data1=cull_20, Data2=duppt_7)  # -> flatten(Result)
del_3 = DelaunayMesh(Points=merge_11, Plane=PlaneXY(0, 0, 0))
wbedges_3 = WeaverbirdsMeshEdges(MeshOrPolylines=del_3)
curvepoint_3 = PointOnCurve(wbedges_3, parameter=0.5)
incurve_2 = PointInCurve(Point=curvepoint_3, Curve=crv_5)  # -> Relationship, Point
explode_5 = Explode(Curve=cluster_3.crv_12, Recursive=True)  # -> Segments, Vertices
explode_6 = Explode(Curve=cluster_3.crv_10, Recursive=True)  # -> Segments, Vertices
move_6 = Move(Geometry=cluster_3.crv_10, Motion=pt_4)  # -> Geometry, Transform
move_7 = Move(Geometry=cluster_3.crv_11, Motion=pt_4)  # -> Geometry, Transform
move_8 = Move(Geometry=cluster_3.crv_12, Motion=pt_4)  # -> Geometry, Transform
equals_3 = Equality(FirstNumber=incurve_2.Relationship, SecondNumber=2)  # -> Equality, Inequality
scale_2 = Scale(Geometry=move_6.Geometry, Center=pt_4, Factor=division)  # -> Geometry, Transform
scale_3 = Scale(Geometry=move_7.Geometry, Center=pt_4, Factor=division)  # -> Geometry, Transform
scale_4 = Scale(Geometry=move_8.Geometry, Center=pt_4, Factor=division)  # -> Geometry, Transform
cull_21 = CullPattern(List=wbedges_3, CullPattern=equals_3.Equality)
G = ClusterOutput(scale_4.Geometry)
G_2 = ClusterOutput(scale_3.Geometry)
G_3 = ClusterOutput(scale_2.Geometry)
dupln_6 = RemoveDuplicateLines(Lines=cull_21, Tolerance=0.01)
merge_12 = Merge(Data1=dupln_6, Data2=explode_5.Segments, Data3=cluster_3.crv_11, Data4=explode_6.Segments)  # -> flatten(Result)
dupln_7 = RemoveDuplicateLines(Lines=merge_12, Tolerance=0.01)
len_5 = Length(Curve=dupln_7)
move_9 = Move(Geometry=dupln_6, Motion=pt_4)  # -> Geometry, Transform
larger_10 = LargerThan(FirstNumber=len_5, SecondNumber=0.01)  # -> LargerThan, OrEqualTo
scale_5 = Scale(Geometry=move_9.Geometry, Center=pt_4, Factor=division)  # -> Geometry, Transform
cull_22 = CullPattern(List=dupln_7, CullPattern=larger_10.LargerThan)
G_4 = ClusterOutput(scale_5.Geometry)
splitcurves = PythonScript(curves=cull_22, tolerance=Slider(0.001, range=0..0.001))  # -> out, pieces; inputs curves: list of Curve; same code as splitcurves
dupln_8 = RemoveDuplicateLines(Lines=splitcurves.pieces, Tolerance=0.01)
len_6 = Length(Curve=dupln_8)
larger_11 = LargerThan(FirstNumber=len_6, SecondNumber=0.01)  # -> LargerThan, OrEqualTo
cull_23 = CullPattern(List=dupln_8, CullPattern=larger_11.LargerThan)
crv_6 = Curve(cull_23)
grid_divisions = Integer(20)
crv_7 = Curve(simplify(crv_6))
x_bounds = Domain(Domain(1950, 3650))
y_bounds = Domain(Domain(2750, 3550))
dom² = Domain²(DomainU=x_bounds, DomainV=y_bounds)
hem_open_xy_networks = VBScript(seg=crv_7, bnd=dom², sbdv=grid_divisions)  # -> out, flatten(e), flatten(eOV), flatten(ePE), flatten(eNE), flatten(eTE), flatten(eIF), flatten(v)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; inputs seg: list of Curve; same code as hem_open_xy_networks
pline_16 = PolyLine(Vertices=hem_open_xy_networks.f, Closed=True)
flatten_5 = FlattenTree(Tree=pline_16, Path="{0}")
srf_2 = Surface(flatten_5)
area_5 = Area(Geometry=srf_2)  # -> Area, Centroid
sort_4 = SortList(Keys=area_5.Area, ValuesA=flatten_5)  # -> Keys, ValuesA
shift = ShiftList(List=sort_4.ValuesA, Shift=-1, Wrap=False)
explode_7 = Explode(Curve=shift, Recursive=True)  # -> Segments, simplify(Vertices)
shift_2 = ShiftList(List=explode_7.Vertices, Shift=1, Wrap=False)  # -> simplify(List)
path_mapper = PathMapper(shift_2, source="{a}", target="{0;a}")
pt_19 = Point(path_mapper)

# ---- group: 迭代更新凹多边形顶点
python_9 = GhPythonScript(pts=pt_19, run=bool_2)  # -> out, a, count, loops; inputs pts: tree of Point3d, run: Boolean; same code as python_9

# ----
pline_17 = PolyLine(Vertices=python_9.a, Closed=True)  # -> flatten(Polyline)
explode_8 = Explode(Curve=pline_17, Recursive=True)  # -> flatten(Segments), Vertices
dupln_9 = RemoveDuplicateLines(Lines=explode_8.Segments, Tolerance=0.01)
move_10 = Move(Geometry=dupln_9, Motion=pt_4)  # -> Geometry, Transform
scale_6 = Scale(Geometry=move_10.Geometry, Center=pt_4, Factor=division)  # -> Geometry, Transform
G_5 = ClusterOutput(scale_6.Geometry)

# ==== cluster Remove1
C = ClusterInput()
end = EndPoints(Curve=C)  # -> Start, End
weave = Weave(Pattern=[0, 1], Stream0=end.Start, Stream1=end.End, NullGaps=False)
cps = ClosestPoints(Point=weave, Cloud=weave, Count=2)  # -> ClosestPoint, CPIndex, Distance
ma = MassAddition(Input=cps.Distance)  # -> flatten(Result), PartialResults
smaller = SmallerThan(FirstNumber=ma.Result, SecondNumber=0.01)  # -> SmallerThan, OrEqualTo
python = GhPythonScript(pd=smaller.SmallerThan, pts=weave)  # -> out, pts; inputs pd: list of Boolean, pts: list of Point3d
# ---------- python: Python ----------
__author__ = "Platina"
__version__ = "2021.08.09"

import rhinoscriptsyntax as rs

count = 1
while count!=0:
    count = 0
    for i in range(len(pd)):
        if pd[i]==False:
            count += 1
            pd[i] = True
            j = rs.PointCloudClosestPoints(pts,[pts[i]],10000)[0][1]
            pts[i] = pts[j]
# ---------- end python ----------
dispatch = Dispatch(List=python.pts, DispatchPattern=[True, False])  # -> ListA, ListB
ln = Line(StartPoint=dispatch.ListA, EndPoint=dispatch.ListB)
len = Length(Curve=ln)
larger = LargerThan(FirstNumber=len, SecondNumber=0.01)  # -> LargerThan, OrEqualTo
cull = CullPattern(List=ln, CullPattern=larger.LargerThan)
dupln = RemoveDuplicateLines(Lines=cull, Tolerance=0.01)
crv = Curve(dupln)
crv_2 = ClusterOutput(crv)

# ==== cluster Cluster
crv = ClusterInput()
crv_2 = ClusterInput()
crv_3 = ClusterInput()
crv_4 = Curve(crv)
crv_5 = Curve(crv_2)
crv_6 = Curve(crv_3)
ccx = CurveCurve(CurveA=crv_4, CurveB=crv_5)  # -> Points, ParamsA, ParamsB
lng = ListLength(List=ccx.Points)
equals = Equality(FirstNumber=lng, SecondNumber=1)  # -> flatten(Equality), Inequality
cull = CullPattern(List=crv_5, CullPattern=equals.Equality)
ccx_2 = CurveCurve(CurveA=crv_6, CurveB=cull)  # -> Points, ParamsA, ParamsB
lng_2 = ListLength(List=ccx_2.Points)
equals_2 = Equality(FirstNumber=lng_2, SecondNumber=1)  # -> flatten(Equality), Inequality
cull_2 = CullPattern(List=cull, CullPattern=equals_2.Equality)
end = EndPoints(Curve=cull_2)  # -> Start, End
pline = PolyLine(Vertices=end.End, Closed=True)
pline_2 = PolyLine(Vertices=end.Start, Closed=True)
crv_7 = Curve(pline_2)
crv_8 = Curve(cull_2)
crv_9 = Curve(pline)
crv_10 = ClusterOutput(crv_9)
crv_11 = ClusterOutput(crv_8)
crv_12 = ClusterOutput(crv_7)
